# Grasshopper definition test.gh (Grasshopper 1.0.8)
# plug-ins: RhinoCodePluginGH, Heteroptera, Pufferfish, Park Design Space Planner, Groundhog, Weaverbird, Nautilus, NGon_RH8

trees = Curve(Tree({0;0;0}: [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], {0;1;0}: [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], {0;2;0}: [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], {0;3;0}: [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], {0;4;0}: [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], {0;5;0}: [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]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))
mesh = Mesh(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)
crv = Curve(<curve referenced from the Rhino model>)
qrsettings = QuadRemeshSettings(
    TargetCount=Slider(10000, range=0..10000),
    AdaptiveSize=0,
    AdaptiveCount=False,
    HardEdges=False,
    SeamEdges=0,
    Symmetry=0,
    GuideCurves=0)
# Easting  ≈ 311,000 m
# Northing ≈ 2,775,000 m
# Elevation = 16
pt = ConstructPoint(
    XCoordinate=Slider(311000, range=0..1000000),
    YCoordinate=Slider(2775000, range=0..10000000),
    ZCoordinate=Slider(16, range=0..100))
qrmesh = QuadRemesh(Geometry=mesh, Settings=qrsettings)
crv_2 = Curve(<curve referenced from the Rhino model>)
pt_2 = Point(Point(357.2859512, 283.3398584, 0))
vec2pt = Vector2Pt(PointA=pt_2, PointB=pt, Unitize=False)  # -> Vector, Length
meshedges = MeshEdges(Mesh=qrmesh)  # -> AllE, NakedE
move = Move(Geometry=trees, Motion=vec2pt.Vector)  # -> Geometry, Transform
move_2 = Move(Geometry=crv_2, Motion=vec2pt.Vector)  # -> Geometry, Transform
move_3 = Move(Geometry=mesh, Motion=vec2pt.Vector)  # -> Geometry, Transform
# 1. GRID_BOUNDARY_MISMATCH: Rhino boundary X 310831..311000, Y 2774868..2775053 does not overlap package grid X 320707..320862, Y 2783284..2783454. Use the correct georeferenced boundary or set Use Package Boundary to True. No coordinates were shifted.
number_slider = Slider(310831.311, range=0..1000000)
number_slider_2 = Slider(2774868, range=0..10000000)
plotboundary = Data(move_2.Geometry)
panel = Panel("C:\Users\shyle\Downloads\al_safa_2_park_design_package_test7")
drec = DeconstructRectangle(Rectangle=move_2.Geometry)  # -> BasePlane, XInterval, YInterval
run = Data(Toggle(True))
data = Data()
design_package = Data()
design_package_2 = Data(panel)
rectangle = Rectangle(Plane=drec.BasePlane, XSize=drec.XInterval, YSize=drec.YInterval, Radius=0)  # -> Rectangle, Length
pt_3 = ConstructPoint(XCoordinate=number_slider, YCoordinate=Slider(2774868.278, range=0..10000000), ZCoordinate=Slider(16, range=0..100))
trigger = Trigger(Interval=10, TimerInterval=10, Target=py3)  # disabled
py3 = Python3Script(reset=Button())  # -> out, a
# ---------- py3: Python ----------
import time
import scriptcontext as sc

key = "gh_timer_start"

# Reset or initialize
if reset or key not in sc.sticky:
    sc.sticky[key] = time.perf_counter()

elapsed = time.perf_counter() - sc.sticky[key]

# Integer output
a = int(elapsed)
# ---------- end py3 ----------
timer = Panel(py3.a)
plotboundary_2 = Data(rectangle.Rectangle)
design_package_3 = Data(design_package_2)
run_2 = Data(run)
parkoptions = GenerateParkAlternatives(
    DesignPackage=design_package_3,
    Seed=Slider(2, range=0..10),
    Alternatives=5,
    Diversity=Slider(0.5, range=0..1),
    SelectedOption=Slider(1, range=0..10),
    Run=run_2)  # -> Spaces, Centres, ProgramIDs, Routes, Nodes, Relationships, ScenarioRecords, SelectedScenario, Warnings, Site
crv_3 = Curve(parkoptions.Nodes)
crv_4 = Curve(parkoptions.Spaces)
run_3 = Data(run)  # disabled
run_4 = Data(run)
treemappaths = TreemapPathNetwork(PrimaryWidth=3, SecondaryWidth=2, ServiceWidth=4, Run=False)  # -> PrimaryPath, SecondaryPaths, ServicePath, Portals, PortalData, CorridorEdges, PathData, Warnings, Summary
design_package_4 = Data(design_package)
area = Area(Geometry=parkoptions.Spaces)  # -> Area, Centroid
run_5 = Data(run)
area_2 = Area(Geometry=plotboundary_2)  # -> Area, Centroid
parkbubbles = DistributeParkSpaces(
    Boundary=plotboundary_2,
    DesignPackage=design_package_3,
    Seed=Slider(3, range=0..10),
    Run=run_2,
    AllPrograms=True,
    Strategy="AUTO",
    UsePackageBoundary=Toggle(True),
    Reseed=False,
    FastPreview=run_4)  # -> Bubbles, Centers, Names, Warnings, Summary, Nodes, NodeNames, Routes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
data_2 = Data(parkbubbles.Bubbles)
area_3 = Area(Geometry=data_2)  # -> Area, Centroid
deconstruct_arc = DeconstructArc(Arc=data_2)  # -> BasePlane, Radius, Angle
cull_duplicates = CullDuplicates(Points=area_3.Centroid, Tolerance=Slider(26, range=0..100), CullMode=1)  # -> Points, Indices, Valence
cull_index = CullIndex(List=deconstruct_arc.Radius, Indices=cull_duplicates.Indices, Wrap=True)
circle_cnr = CircleCNR(Center=cull_duplicates.Points, Normal=Vector(0, 0, 1), Radius=cull_index)
accessfitness = EvaluateAccessCombination(DesignPackage=design_package_4, MainIndex=0, SecondaryIndex=1, ServiceIndex=2, Run=run_5)  # -> MainPoint, SecondaryPoint, ServicePoint, SelectedIDs, Valid, HardViolations, CombinedPopulation, AdditionalPopulation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
pt_4 = Point(<point referenced from the Rhino model>)
pt_5 = Point(<point referenced from the Rhino model>)
number_slider_3 = Slider(2, range=0..10)
number_slider_4 = Slider(0.9, range=0..1)
crv_5 = Curve(parkbubbles.Bubbles)
pt_6 = Point(accessfitness.ServicePoint)
crv_6 = Curve(parkbubbles.ResolvedBoundary)
crv_7 = Curve(parkbubbles.DuneMorphologyAxes)
crv_8 = Curve(parkbubbles.RouteCorridorEdges)
trigger_2 = Trigger(Interval=10, TimerInterval=10, Target=py3_2)  # disabled
run_6 = Data(run)
number_slider_5 = Slider(1000, range=0..1000)
design_package_5 = Data(design_package_2)

# ---- group: Base Mesh
# Example 2 (Right)
mesh_2 = Mesh(<mesh referenced from the Rhino model>)

# ----
total_flow_volume_total = Slider(1000, range=100..1000)
proximity_threshold = Slider(20, range=0..200)
flow_step_size = Slider(81, range=0..100)
grid_divisions = Slider(31, range=0..100)

crv_9 = Curve(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)
number_slider_6 = Slider(45, range=0..100)
number_slider_7 = Slider(15, range=0..100)

flow_step_size_2 = Slider(2, range=0..100)
# Example 2 (Center)
random_points_count = Slider(1000, range=0..1000)
flow_step_limit = Slider(1, range=0..100)
multithread = BooleanToggle(True)

area_4 = Area(Geometry=crv_9)  # -> Area, Centroid
mesh_3 = Mesh(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)
crv_10 = Curve(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)
bakepark = BakeParkPlanningGeometry(
    CleanGeometry=parkbubbles.CleanGeometry,
    GeometryNames=parkbubbles.CleanGeometryNames,
    LayerPaths=parkbubbles.CleanGeometryLayers,
    Bake=Button(),
    ReplacePrevious=True)  # -> ObjectIDs, LayerPaths, Summary
pt_7 = Point(<point referenced from the Rhino model>)
mesh_4 = Mesh(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)
slope = MeshSlope(Mesh=mesh_4)  # -> MeshFaces, FaceCenters, FaceVectors, FaceSlopes, FaceSlopes_2, FaceSlopes_3
genes = GenePool(Decimals=2, Maximum=100, Minimum=0, Value=[28.42, 62.61, 24, 22.41])
py3_2 = Python3Script(reset=Button())  # -> out, a; same code as py3
scale = Scale(Geometry=crv_9, Center=area_4.Centroid, Factor=Slider(1.5, range=0..10))  # -> Geometry, Transform
crv_11 = Curve(parkbubbles.DuneMorphologyAxes)
genes_2 = GenePool(
    Decimals=2,
    Maximum=100,
    Minimum=0,
    Value=[83.07192594, 22.20632893, 74.8693161, 4.937451386, 22.9400433, 17.30139035, 56.22547952, 32.97553121, 7.558121894, 17.59902266])
voronoi = Voronoi(Points=parkbubbles.Centers, Boundary=parkbubbles.ResolvedBoundary, BruteForceOverride=False)
merge = Merge()

# ---- group: Base Mesh
mesh_5 = Mesh(<mesh referenced from the Rhino model>)

# ----
pop2d = Populate2D(Region=scale.Geometry, Count=Slider(1000, range=0..10000), Seed=1)
area_5 = Area(Geometry=parkbubbles.ResolvedBoundary)  # -> Area, Centroid
vec2pt_2 = Vector2Pt(PointA=area_2.Centroid, PointB=area_5.Centroid, Unitize=False)  # -> Vector, Length
move_4 = Move(Geometry=plotboundary_2, Motion=vec2pt_2.Vector)  # -> Geometry, Transform
move_5 = Move(Geometry=move.Geometry, Motion=vec2pt_2.Vector)  # -> Geometry, Transform
move_6 = Move(Geometry=move_3.Geometry, Motion=vec2pt_2.Vector)  # -> Geometry, Transform
area_6 = Area(Geometry=move_4.Geometry)  # -> Area, Centroid
number_slider_8 = Slider(27, range=0..100)
line = Line(Line((320773, 2783326, 0), (320756, 2783358, 0)))
extremes = MinMax(Number=slope.FaceSlopes_2)  # -> Minimum, Maximum
proximity_threshold_2 = Slider(58, range=0..200)
explode = Explode(Curve=move_4.Geometry, Recursive=True)  # -> Segments, Vertices
panel_2 = Panel(py3_2.a)
scale_2 = Scale(Geometry=move_4.Geometry, Center=area_6.Centroid, Factor=Slider(0.95, range=0..1))  # -> Geometry, Transform
c_script = CSharpScript(C=scale_2.Geometry, Radii=genes)  # -> out, Result, Pieces; inputs C: Curve, Radii: list of Double
# ---------- c_script: C# ----------
#region Usings
using System;
using System.Linq;
using System.Collections;
using System.Collections.Generic;

using Rhino;
using Rhino.Geometry;

using Grasshopper;
using Grasshopper.Kernel;
using Grasshopper.Kernel.Data;
using Grasshopper.Kernel.Types;
#endregion

public class Script_Instance : GH_ScriptInstance
{
    private void RunScript(
		Curve C,
		List<double> Radii,
		ref object Result,
		ref object Pieces)
    {
        if (C == null)
            return;

        if (Radii == null || Radii.Count < 4)
        {
            Print("Provide 4 radius values.");
            return;
        }

        // ---------------------------------------
        // Get polyline
        // ---------------------------------------

        Polyline polyline;

        if (!C.TryGetPolyline(out polyline))
        {
            Print("Input must be a polyline.");
            return;
        }

        if (!polyline.IsClosed)
        {
            Print("Polyline must be closed.");
            return;
        }

        // Closed polyline contains duplicated last point
        if (polyline.Count != 5)
        {
            Print("Input must have exactly 4 sides.");
            return;
        }

        Point3d[] V = new Point3d[4];

        for (int i = 0; i < 4; i++)
            V[i] = polyline[i];

        Plane plane;

        if (!C.TryGetPlane(out plane))
            plane = Plane.WorldXY;

        // Tangent points on each side of every corner
        Point3d[] tangentIncoming = new Point3d[4];
        Point3d[] tangentOutgoing = new Point3d[4];

        Arc[] fillets = new Arc[4];

        // ---------------------------------------
        // Calculate each corner independently
        // ---------------------------------------

        for (int i = 0; i < 4; i++)
        {
            int prev = (i + 3) % 4;
            int next = (i + 1) % 4;

            Point3d vertex = V[i];

            Vector3d toPrev = V[prev] - vertex;
            Vector3d toNext = V[next] - vertex;

            double lenPrev = toPrev.Length;
            double lenNext = toNext.Length;

            toPrev.Unitize();
            toNext.Unitize();

            double radius = Math.Max(0.0, Radii[i]);

            // Interior angle
            double dot = Vector3d.Multiply(toPrev, toNext);
            dot = Math.Max(-1.0, Math.Min(1.0, dot));

            double angle = Math.Acos(dot);

            if (radius <= 0.000001 ||
                angle <= 0.000001 ||
                Math.Abs(Math.PI - angle) <= 0.000001)
            {
                tangentIncoming[i] = vertex;
                tangentOutgoing[i] = vertex;

                fillets[i] = Arc.Unset;
                continue;
            }

            // Distance from corner to tangent point
            double tangentDistance =
                radius / Math.Tan(angle * 0.5);

            // Prevent radius from extending beyond sides
            double maxDistance =
                Math.Min(lenPrev, lenNext) * 0.49;

            if (tangentDistance > maxDistance)
            {
                tangentDistance = maxDistance;

                // Recalculate radius from clamped tangent distance
                radius =
                    tangentDistance *
                    Math.Tan(angle * 0.5);
            }

            Point3d pA =
                vertex +
                toPrev * tangentDistance;

            Point3d pB =
                vertex +
                toNext * tangentDistance;

            tangentIncoming[i] = pA;
            tangentOutgoing[i] = pB;

            // ---------------------------------------
            // Fillet centre
            // ---------------------------------------

            Vector3d bisector =
                toPrev + toNext;

            if (!bisector.Unitize())
            {
                fillets[i] = Arc.Unset;
                continue;
            }

            double centerDistance =
                radius /
                Math.Sin(angle * 0.5);

            Point3d center =
                vertex +
                bisector * centerDistance;

            // ---------------------------------------
            // Create middle point on correct arc
            // ---------------------------------------

            Vector3d a =
                pA - center;

            Vector3d b =
                pB - center;

            a.Unitize();
            b.Unitize();

            Vector3d midDir =
                a + b;

            if (!midDir.Unitize())
            {
                fillets[i] = Arc.Unset;
                continue;
            }

            // We want the arc facing away from the corner
            Point3d mid =
                center +
                midDir * radius;

            Arc arc =
                new Arc(
                    pA,
                    mid,
                    pB
                );

            fillets[i] = arc;
        }

        // ---------------------------------------
        // Build alternating:
        //
        // line
        // fillet
        // line
        // fillet
        // ...
        // ---------------------------------------

        List<Curve> pieces =
            new List<Curve>();

        for (int i = 0; i < 4; i++)
        {
            int next = (i + 1) % 4;

            // Side starts after fillet at current corner
            Point3d sideStart =
                tangentOutgoing[i];

            // Side finishes before fillet at next corner
            Point3d sideEnd =
                tangentIncoming[next];

            if (sideStart.DistanceTo(sideEnd) > 0.000001)
            {
                pieces.Add(
                    new LineCurve(
                        sideStart,
                        sideEnd
                    )
                );
            }

            // Add fillet at next corner
            if (fillets[next].IsValid)
            {
                pieces.Add(
                    new ArcCurve(
                        fillets[next]
                    )
                );
            }
        }

        // ---------------------------------------
        // Join
        // ---------------------------------------

        Curve[] joined =
            Curve.JoinCurves(
                pieces,
                RhinoDoc.ActiveDoc.ModelAbsoluteTolerance
            );

        if (joined != null &&
            joined.Length > 0)
        {
            Result = joined[0];
        }

        Pieces = pieces;
    }
}
# ---------- end c_script ----------

# ---- group: Distribute points randomly on mesh for path starts
cluster = Cluster(C=mesh_4, N=random_points_count)

# ----
number_slider_9 = Slider(5, range=0..10)
area_7 = Area(Geometry=move_4.Geometry)  # -> Area, Centroid
gradient = Gradient(
    LowerLimit=extremes.Minimum,
    UpperLimit=extremes.Maximum,
    Parameter=slope.FaceSlopes_2,
    stops=[0: RGB(0, 128, 0), 0.5: RGB(255, 255, 0), 1: RGB(255, 0, 0)])
item = ListItem(List=explode.Segments, Index=0, Wrap=True)  # -> Item, Item1, Item2, Item3
# PointSpacing       3
# Iterations         150
# StepSize           0.20
# 
# ExpansionForce     0.8
# SpringForce        0.35
# SmoothForce        0.75
# 
# BoundaryForce      2.5
# BoundaryMargin     3
# 
# SelfRepulsion      1.5
# RepulsionDistance  10
# 
# TargetLength       400
# LengthForce        0.6
# 
# MaxSlope           0.08
# SlopeForce         1.0
number_slider_10 = Slider(3, range=0..10)
number_slider_11 = Slider(1, range=0..10)
genes_3 = GenePool(Decimals=1, Maximum=0.9, Minimum=0.1, Value=[0.4, 0.2, 0.6, 0.2])
mesh_paint = MeshColorByFace(Mesh=mesh_4, Colors=gradient)
number_slider_12 = Slider(4, range=0..5)
crv_12 = Curve(c_script.Result)
number_slider_13 = Slider(0.028, range=0..0.03)
area_8 = Area(Geometry=parkbubbles.Bubbles)  # -> Area, Centroid
crv_13 = Curve([item.Item1, item.Item3])
crv_14 = Curve([item.Item2, item.Item])
number_slider_14 = Slider(13, range=0..100)
number_slider_15 = Slider(2, range=0..100)
number_slider_16 = Slider(0.04, range=0..0.1)
number_slider_17 = Slider(0.14, range=0..1)

# ---- group: Calculate the flow paths (for mesh)
mesh_flows = FlowSimulationMesh(Mesh=mesh_4, Points=pop2d, Fidelity=flow_step_size_2, Steps=py3_2.a, Thread=multithread)  # -> FlowPoints, FlowPaths

# ----
scale_3 = Scale(Geometry=move_4.Geometry, Center=area_7.Centroid, Factor=Slider(0.9, range=0..1))  # -> Geometry, Transform
scale_4 = Scale(Geometry=move_4.Geometry, Center=area_7.Centroid, Factor=Slider(0.8, range=0..1))  # -> Geometry, Transform
number_slider_18 = Slider(2, range=0..10)
number_slider_19 = Slider(1, range=0..1)
c_script_2 = CSharpScript(
    Centroids=area.Centroid,
    Areas=area.Area,
    Boundary=parkbubbles.ResolvedBoundary,
    MinAspect=number_slider_19,
    Seed=Slider(9, range=0..10))  # -> out, Cells, CellCenters, ActualAreas, TargetAreas, AreaError, Displacement, LocalPlane; inputs Centroids: list of Point3d, Areas: list of Double, Boundary: Curve, MinAspect: Double, Seed: Int32
# ---------- c_script_2: C# ----------
#region Usings
using System;
using System.Linq;
using System.Collections;
using System.Collections.Generic;
using System.Drawing;

using Rhino;
using Rhino.Geometry;

using Grasshopper;
using Grasshopper.Kernel;
using Grasshopper.Kernel.Data;
using Grasshopper.Kernel.Types;
#endregion

public class Script_Instance : GH_ScriptInstance
{
    // ============================================================
    // ROTATED + SEEDED SPATIAL RECTANGULAR CARTOGRAM / TREEMAP
    //
    // INPUTS
    // ------------------------------------------------------------
    // Centroids : List<Point3d>
    // Areas     : List<double>
    // Boundary  : Curve
    // MinAspect : double
    // Seed      : int
    //
    // OUTPUTS
    // ------------------------------------------------------------
    // Cells
    // CellCenters
    // ActualAreas
    // TargetAreas
    // AreaError
    // Displacement
    // LocalPlane
    //
    // ============================================================


    // ============================================================
    // ITEM
    // ============================================================

    private class Item
    {
        public int Index;

        public Point3d OriginalPoint;
        public Point3d LocalPoint;

        public double OriginalArea;
        public double ScaledArea;

        public Rect Rectangle;


        public Item(
            int index,
            Point3d originalPoint,
            Point3d localPoint,
            double area)
        {
            Index = index;

            OriginalPoint = originalPoint;
            LocalPoint = localPoint;

            OriginalArea = area;
            ScaledArea = area;
        }
    }


    // ============================================================
    // LOCAL RECTANGLE
    // ============================================================

    private class Rect
    {
        public double X;
        public double Y;

        public double W;
        public double H;


        public Rect(
            double x,
            double y,
            double w,
            double h)
        {
            X = x;
            Y = y;

            W = w;
            H = h;
        }


        public double Area
        {
            get
            {
                return W * H;
            }
        }


        public Point3d Center
        {
            get
            {
                return new Point3d(
                    X + W * 0.5,
                    Y + H * 0.5,
                    0);
            }
        }
    }


    // ============================================================
    // MAIN
    // ============================================================

    private void RunScript(
		List<Point3d> Centroids,
		List<double> Areas,
		Curve Boundary,
		double MinAspect,
		int Seed,
		ref object Cells,
		ref object CellCenters,
		ref object ActualAreas,
		ref object TargetAreas,
		ref object AreaError,
		ref object Displacement,
		ref object LocalPlane)
    {
        // ========================================================
        // VALIDATE
        // ========================================================

        if (Centroids == null ||
            Centroids.Count == 0)
        {
            Print(
                "No centroids supplied.");

            return;
        }


        if (Areas == null ||
            Areas.Count == 0)
        {
            Print(
                "No areas supplied.");

            return;
        }


        if (Boundary == null ||
            !Boundary.IsClosed)
        {
            Print(
                "Boundary must be a closed curve.");

            return;
        }


        int n =
            Math.Min(
                Centroids.Count,
                Areas.Count);


        if (MinAspect <= 0)
            MinAspect = 0.15;


        MinAspect =
            Math.Max(
                0.02,
                Math.Min(
                    1.0,
                    MinAspect));


        double tolerance =
            RhinoDocument != null
            ? RhinoDocument.ModelAbsoluteTolerance
            : 0.001;


        Random random =
            new Random(
                Seed);


        // ========================================================
        // CREATE SITE-ALIGNED PLANE
        //
        // Longest boundary edge = Local X-axis.
        // ========================================================

        Plane sitePlane;


        if (!CreateBoundaryPlane(
            Boundary,
            tolerance,
            out sitePlane))
        {
            Print(
                "Could not determine site orientation.");

            return;
        }


        // ========================================================
        // TRANSFORMS
        // ========================================================

        Transform worldToLocal =
            Transform.PlaneToPlane(
                sitePlane,
                Plane.WorldXY);


        Transform localToWorld =
            Transform.PlaneToPlane(
                Plane.WorldXY,
                sitePlane);


        // ========================================================
        // TRANSFORM BOUNDARY INTO LOCAL XY
        // ========================================================

        Curve localBoundary =
            Boundary.DuplicateCurve();


        localBoundary.Transform(
            worldToLocal);


        BoundingBox bb =
            localBoundary.GetBoundingBox(
                true);


        double parkWidth =
            bb.Max.X -
            bb.Min.X;


        double parkHeight =
            bb.Max.Y -
            bb.Min.Y;


        if (parkWidth <= tolerance ||
            parkHeight <= tolerance)
        {
            Print(
                "Invalid boundary dimensions.");

            return;
        }


        Rect park =
            new Rect(
                bb.Min.X,
                bb.Min.Y,
                parkWidth,
                parkHeight);


        // ========================================================
        // CREATE ITEMS IN LOCAL COORDINATES
        // ========================================================

        List<Item> items =
            new List<Item>();


        double totalRequestedArea =
            0;


        for (int i = 0;
             i < n;
             i++)
        {
            double area =
                Math.Max(
                    Areas[i],
                    0.0001);


            Point3d localPoint =
                Centroids[i];


            localPoint.Transform(
                worldToLocal);


            Item item =
                new Item(
                    i,
                    Centroids[i],
                    localPoint,
                    area);


            items.Add(
                item);


            totalRequestedArea +=
                area;
        }


        if (totalRequestedArea <=
            0.0001)
        {
            Print(
                "Total program area is invalid.");

            return;
        }


        // ========================================================
        // SCALE PROGRAM AREAS TO PARK RECTANGLE
        // ========================================================

        double parkArea =
            park.Area;


        double scale =
            parkArea /
            totalRequestedArea;


        foreach (
            Item item
            in items)
        {
            item.ScaledArea =
                item.OriginalArea *
                scale;
        }


        // ========================================================
        // SOLVE SEEDED SPATIAL TREEMAP
        // ========================================================

        SolveSpatialTreemap(
            items,
            park,
            MinAspect,
            random);


        // ========================================================
        // RETURN TO ORIGINAL ORDER
        // ========================================================

        items =
            items
            .OrderBy(
                x => x.Index)
            .ToList();


        // ========================================================
        // OUTPUT CONTAINERS
        // ========================================================

        List<Curve> outputCells =
            new List<Curve>();


        List<Point3d> outputCenters =
            new List<Point3d>();


        List<double> actualAreas =
            new List<double>();


        List<double> targetAreas =
            new List<double>();


        List<double> areaErrors =
            new List<double>();


        List<double> displacements =
            new List<double>();


        // ========================================================
        // CREATE WORLD-SPACE OUTPUT
        // ========================================================

        foreach (
            Item item
            in items)
        {
            Rect r =
                item.Rectangle;


            // ----------------------------------------------------
            // Cell curve in local XY
            // ----------------------------------------------------

            Curve cell =
                RectToCurve(
                    r);


            // ----------------------------------------------------
            // Transform back into boundary orientation
            // ----------------------------------------------------

            cell.Transform(
                localToWorld);


            outputCells.Add(
                cell);


            // ----------------------------------------------------
            // Center
            // ----------------------------------------------------

            Point3d center =
                r.Center;


            center.Transform(
                localToWorld);


            outputCenters.Add(
                center);


            // ----------------------------------------------------
            // Area
            // ----------------------------------------------------

            double actualArea =
                r.Area;


            actualAreas.Add(
                actualArea);


            targetAreas.Add(
                item.ScaledArea);


            double error =
                Math.Abs(
                    actualArea -
                    item.ScaledArea)
                /
                Math.Max(
                    item.ScaledArea,
                    0.0001)
                *
                100.0;


            areaErrors.Add(
                error);


            // ----------------------------------------------------
            // Distance to original centroid
            // ----------------------------------------------------

            double displacement =
                center.DistanceTo(
                    item.OriginalPoint);


            displacements.Add(
                displacement);
        }


        // ========================================================
        // ASSIGN OUTPUTS
        // ========================================================

        Cells =
            outputCells;


        CellCenters =
            outputCenters;


        ActualAreas =
            actualAreas;


        TargetAreas =
            targetAreas;


        AreaError =
            areaErrors;


        Displacement =
            displacements;


        LocalPlane =
            sitePlane;


        // ========================================================
        // REPORT
        // ========================================================

        Print(
            "Rotated seeded spatial treemap generated.");


        Print(
            "Seed: {0}",
            Seed);


        Print(
            "Park Area: {0:0.00}",
            parkArea);


        Print(
            "Requested Program Area: {0:0.00}",
            totalRequestedArea);


        Print(
            "Scale Factor: {0:0.000}",
            scale);


        Print(
            "Local Width: {0:0.00}",
            parkWidth);


        Print(
            "Local Height: {0:0.00}",
            parkHeight);


        Print(
            "Programs: {0}",
            n);
    }


    // ============================================================
    // RECURSIVE SEEDED SPATIAL TREEMAP
    // ============================================================

    private void SolveSpatialTreemap(
        List<Item> items,
        Rect rect,
        double minAspect,
        Random random)
    {
        // ========================================================
        // VALIDATE
        // ========================================================

        if (items == null ||
            items.Count == 0)
        {
            return;
        }


        // ========================================================
        // BASE CASE
        // ========================================================

        if (items.Count == 1)
        {
            items[0].Rectangle =
                rect;

            return;
        }


        // ========================================================
        // LOCAL CENTROID DISTRIBUTION
        // ========================================================

        double minPX =
            items.Min(
                i =>
                i.LocalPoint.X);


        double maxPX =
            items.Max(
                i =>
                i.LocalPoint.X);


        double minPY =
            items.Min(
                i =>
                i.LocalPoint.Y);


        double maxPY =
            items.Max(
                i =>
                i.LocalPoint.Y);


        double spreadX =
            maxPX -
            minPX;


        double spreadY =
            maxPY -
            minPY;


        // ========================================================
        // CHOOSE SPLIT DIRECTION
        //
        // Strong centroid signal:
        // preserve centroid direction.
        //
        // Ambiguous distribution:
        // use seeded variation.
        // ========================================================

        bool splitVertical;


        double minSpread =
            Math.Min(
                spreadX,
                spreadY);


        double maxSpread =
            Math.Max(
                spreadX,
                spreadY);


        double directionRatio;


        if (minSpread <
            0.0001)
        {
            directionRatio =
                maxSpread > 0
                ? Double.MaxValue
                : 1.0;
        }
        else
        {
            directionRatio =
                maxSpread /
                minSpread;
        }


        // --------------------------------------------------------
        // Strong directional preference
        // --------------------------------------------------------

        if (directionRatio >
            1.35)
        {
            splitVertical =
                spreadX >
                spreadY;
        }

        else
        {
            // ----------------------------------------------------
            // Seed controls ambiguous cases.
            //
            // Rectangle shape provides probability bias.
            // Wide rect -> higher chance vertical split.
            // Tall rect -> higher chance horizontal split.
            // ----------------------------------------------------

            double rectangleBias =
                rect.W /
                Math.Max(
                    rect.W +
                    rect.H,
                    0.0001);


            double randomValue =
                random.NextDouble();


            splitVertical =
                randomValue <
                rectangleBias;
        }


        // ========================================================
        // SORT CENTROIDS IN LOCAL SPACE
        // ========================================================

        List<Item> sorted;


        if (splitVertical)
        {
            sorted =
                items
                .OrderBy(
                    i =>
                    i.LocalPoint.X)
                .ThenBy(
                    i =>
                    i.LocalPoint.Y)
                .ToList();
        }

        else
        {
            sorted =
                items
                .OrderBy(
                    i =>
                    i.LocalPoint.Y)
                .ThenBy(
                    i =>
                    i.LocalPoint.X)
                .ToList();
        }


        // ========================================================
        // CALCULATE AREA BALANCE
        // ========================================================

        double totalArea =
            sorted.Sum(
                i =>
                i.ScaledArea);


        double halfArea =
            totalArea *
            0.5;


        double cumulative =
            0;


        double bestDifference =
            Double.MaxValue;


        // ========================================================
        // FIND OPTIMAL AREA SPLIT DIFFERENCE
        // ========================================================

        for (int i = 1;
             i < sorted.Count;
             i++)
        {
            cumulative +=
                sorted[
                    i - 1]
                .ScaledArea;


            double difference =
                Math.Abs(
                    cumulative -
                    halfArea);


            if (difference <
                bestDifference)
            {
                bestDifference =
                    difference;
            }
        }


        // ========================================================
        // COLLECT NEAR-OPTIMAL SPLITS
        //
        // Seed selects among these alternatives.
        // ========================================================

        List<int> possibleSplits =
            new List<int>();


        cumulative =
            0;


        double splitTolerance =
            totalArea *
            0.15;


        for (int i = 1;
             i < sorted.Count;
             i++)
        {
            cumulative +=
                sorted[
                    i - 1]
                .ScaledArea;


            double difference =
                Math.Abs(
                    cumulative -
                    halfArea);


            if (difference <=
                bestDifference +
                splitTolerance)
            {
                possibleSplits.Add(
                    i);
            }
        }


        // ========================================================
        // SEEDED SPLIT INDEX
        // ========================================================

        int splitIndex;


        if (possibleSplits.Count >
            0)
        {
            int randomIndex =
                random.Next(
                    possibleSplits.Count);


            splitIndex =
                possibleSplits[
                    randomIndex];
        }

        else
        {
            splitIndex =
                Math.Max(
                    1,
                    sorted.Count /
                    2);
        }


        // ========================================================
        // CREATE GROUPS
        // ========================================================

        List<Item> groupA =
            sorted
            .Take(
                splitIndex)
            .ToList();


        List<Item> groupB =
            sorted
            .Skip(
                splitIndex)
            .ToList();


        // Safety
        if (groupA.Count == 0 ||
            groupB.Count == 0)
        {
            splitIndex =
                Math.Max(
                    1,
                    sorted.Count /
                    2);


            groupA =
                sorted
                .Take(
                    splitIndex)
                .ToList();


            groupB =
                sorted
                .Skip(
                    splitIndex)
                .ToList();
        }


        // ========================================================
        // GROUP AREAS
        // ========================================================

        double areaA =
            groupA.Sum(
                i =>
                i.ScaledArea);


        double areaB =
            groupB.Sum(
                i =>
                i.ScaledArea);


        double ratio =
            areaA /
            Math.Max(
                areaA +
                areaB,
                0.0001);


        // ========================================================
        // PREVENT EXTREME RATIOS
        //
        // Normally unnecessary, but avoids numerical disaster.
        // ========================================================

        ratio =
            Math.Max(
                0.0001,
                Math.Min(
                    0.9999,
                    ratio));


        // ========================================================
        // ASPECT RATIO QUALITY TEST
        //
        // Seed variation is allowed,
        // but poor geometry can override it.
        // ========================================================

        if (splitVertical)
        {
            double widthA =
                rect.W *
                ratio;


            double widthB =
                rect.W -
                widthA;


            double aspectA =
                AspectRatio(
                    widthA,
                    rect.H);


            double aspectB =
                AspectRatio(
                    widthB,
                    rect.H);


            double currentQuality =
                Math.Min(
                    aspectA,
                    aspectB);


            if (currentQuality <
                minAspect)
            {
                // ------------------------------------------------
                // Test alternative horizontal split
                // ------------------------------------------------

                double heightA =
                    rect.H *
                    ratio;


                double heightB =
                    rect.H -
                    heightA;


                double altA =
                    AspectRatio(
                        rect.W,
                        heightA);


                double altB =
                    AspectRatio(
                        rect.W,
                        heightB);


                double alternativeQuality =
                    Math.Min(
                        altA,
                        altB);


                if (alternativeQuality >
                    currentQuality)
                {
                    splitVertical =
                        false;
                }
            }
        }

        else
        {
            double heightA =
                rect.H *
                ratio;


            double heightB =
                rect.H -
                heightA;


            double aspectA =
                AspectRatio(
                    rect.W,
                    heightA);


            double aspectB =
                AspectRatio(
                    rect.W,
                    heightB);


            double currentQuality =
                Math.Min(
                    aspectA,
                    aspectB);


            if (currentQuality <
                minAspect)
            {
                // ------------------------------------------------
                // Test alternative vertical split
                // ------------------------------------------------

                double widthA =
                    rect.W *
                    ratio;


                double widthB =
                    rect.W -
                    widthA;


                double altA =
                    AspectRatio(
                        widthA,
                        rect.H);


                double altB =
                    AspectRatio(
                        widthB,
                        rect.H);


                double alternativeQuality =
                    Math.Min(
                        altA,
                        altB);


                if (alternativeQuality >
                    currentQuality)
                {
                    splitVertical =
                        true;
                }
            }
        }


        // ========================================================
        // CREATE CHILD RECTANGLES
        // ========================================================

        Rect rectA;
        Rect rectB;


        if (splitVertical)
        {
            // ----------------------------------------------------
            // LEFT / RIGHT
            // ----------------------------------------------------

            double widthA =
                rect.W *
                ratio;


            double widthB =
                rect.W -
                widthA;


            rectA =
                new Rect(
                    rect.X,
                    rect.Y,
                    widthA,
                    rect.H);


            rectB =
                new Rect(
                    rect.X +
                    widthA,
                    rect.Y,
                    widthB,
                    rect.H);
        }

        else
        {
            // ----------------------------------------------------
            // BOTTOM / TOP
            // ----------------------------------------------------

            double heightA =
                rect.H *
                ratio;


            double heightB =
                rect.H -
                heightA;


            rectA =
                new Rect(
                    rect.X,
                    rect.Y,
                    rect.W,
                    heightA);


            rectB =
                new Rect(
                    rect.X,
                    rect.Y +
                    heightA,
                    rect.W,
                    heightB);
        }


        // ========================================================
        // RECURSE
        //
        // SAME RANDOM GENERATOR:
        // deterministic for the same seed.
        // ========================================================

        SolveSpatialTreemap(
            groupA,
            rectA,
            minAspect,
            random);


        SolveSpatialTreemap(
            groupB,
            rectB,
            minAspect,
            random);
    }


    // ============================================================
    // CREATE SITE PLANE FROM BOUNDARY
    //
    // Uses longest straight boundary edge.
    //
    // ============================================================

    private bool CreateBoundaryPlane(
        Curve boundary,
        double tolerance,
        out Plane plane)
    {
        plane =
            Plane.WorldXY;


        Polyline polyline;


        // ========================================================
        // BEST CASE: POLYLINE
        // ========================================================

        if (boundary.TryGetPolyline(
            out polyline))
        {
            if (polyline.Count <
                2)
            {
                return false;
            }


            double longest =
                0;


            Vector3d bestDirection =
                Vector3d.XAxis;


            for (int i = 0;
                 i <
                 polyline.Count - 1;
                 i++)
            {
                Vector3d direction =
                    polyline[
                        i + 1]
                    -
                    polyline[i];


                // Treemap is planar
                direction.Z =
                    0;


                double length =
                    direction.Length;


                if (length >
                    longest)
                {
                    longest =
                        length;


                    bestDirection =
                        direction;
                }
            }


            if (bestDirection.Length <=
                tolerance)
            {
                return false;
            }


            if (!bestDirection.Unitize())
            {
                return false;
            }


            Vector3d yAxis =
                new Vector3d(
                    -bestDirection.Y,
                    bestDirection.X,
                    0);


            if (!yAxis.Unitize())
            {
                return false;
            }


            Point3d center =
                GetBoundaryCentroid(
                    boundary);


            plane =
                new Plane(
                    center,
                    bestDirection,
                    yAxis);


            return
                plane.IsValid;
        }


        // ========================================================
        // FALLBACK:
        // SAMPLE CURVE SEGMENTS
        // ========================================================

        int samples =
            200;


        double bestLength =
            0;


        Vector3d best =
            Vector3d.XAxis;


        Point3d previous =
            boundary.PointAtStart;


        for (int i = 1;
             i <= samples;
             i++)
        {
            double normalized =
                (double)i /
                samples;


            double parameter =
                boundary.Domain.ParameterAt(
                    normalized);


            Point3d current =
                boundary.PointAt(
                    parameter);


            Vector3d direction =
                current -
                previous;


            direction.Z =
                0;


            double length =
                direction.Length;


            if (length >
                bestLength)
            {
                bestLength =
                    length;


                best =
                    direction;
            }


            previous =
                current;
        }


        if (best.Length <=
            tolerance)
        {
            return false;
        }


        if (!best.Unitize())
        {
            return false;
        }


        Vector3d perpendicular =
            new Vector3d(
                -best.Y,
                best.X,
                0);


        if (!perpendicular.Unitize())
        {
            return false;
        }


        plane =
            new Plane(
                GetBoundaryCentroid(
                    boundary),
                best,
                perpendicular);


        return
            plane.IsValid;
    }


    // ============================================================
    // BOUNDARY CENTROID
    // ============================================================

    private Point3d GetBoundaryCentroid(
        Curve boundary)
    {
        AreaMassProperties amp =
            AreaMassProperties.Compute(
                boundary);


        if (amp != null)
        {
            Point3d centroid =
                amp.Centroid;


            amp.Dispose();


            return centroid;
        }


        return
            boundary
            .GetBoundingBox(
                true)
            .Center;
    }


    // ============================================================
    // RECTANGLE -> CURVE
    // ============================================================

    private Curve RectToCurve(
        Rect rect)
    {
        Polyline polyline =
            new Polyline();


        polyline.Add(
            new Point3d(
                rect.X,
                rect.Y,
                0));


        polyline.Add(
            new Point3d(
                rect.X +
                rect.W,
                rect.Y,
                0));


        polyline.Add(
            new Point3d(
                rect.X +
                rect.W,
                rect.Y +
                rect.H,
                0));


        polyline.Add(
            new Point3d(
                rect.X,
                rect.Y +
                rect.H,
                0));


        polyline.Add(
            new Point3d(
                rect.X,
                rect.Y,
                0));


        return
            polyline
            .ToNurbsCurve();
    }


    // ============================================================
    // ASPECT RATIO
    //
    // 1.0 = square
    // 0.5 = 1:2
    // 0.2 = 1:5
    // ============================================================

    private double AspectRatio(
        double width,
        double height)
    {
        if (width <=
            0 ||
            height <=
            0)
        {
            return 0;
        }


        double min =
            Math.Min(
                width,
                height);


        double max =
            Math.Max(
                width,
                height);


        return
            min /
            max;
    }
}
# ---------- end c_script_2 ----------
area_9 = Area(Geometry=c_script_2.Cells)  # -> Area, Centroid
scale_5 = Scale(Geometry=c_script_2.Cells, Center=c_script_2.CellCenters, Factor=Slider(0.5, range=0..1))  # -> Geometry, Transform
tag = TextTag(Location=c_script_2.CellCenters, Text=parkoptions.ProgramIDs)
panel_3 = Panel(area_2.Area)
number_slider_20 = Slider(9, range=0..10)
merge_2 = Merge(Data1=crv_13, Data2=crv_14)
crv_15 = Curve(mesh_flows.FlowPaths)
contour_clip = ContourClipper(ContourCurves=mesh_4)  # -> Contours, EdgedContours, PlanarSurfaces
toggle = BooleanToggle(True)
rubberband1 = RubberBand1(Circles=circle_cnr, SortCircles=toggle)
construct_domain = ConstructDomain(DomainStart=Slider(3, range=0..100), DomainEnd=Slider(8, range=0..100))
populate_geometry = PopulateGeometry(Geometry=scale_4.Geometry, Count=Slider(17, range=0..100), Seed=Slider(31, range=0..100))
eval = EvaluateCurve(Curve=reparameterize(merge_2), Parameter=genes_3)  # -> Point, Tangent, Angle
toggle_2 = BooleanToggle(True)
pop2d_2 = Populate2D(Region=scale_3.Geometry, Count=number_slider_14, Seed=1)
c_script_3 = CSharpScript(
    BaseCurve=crv_12,
    Boundary=move_4.Geometry,
    TopoMesh=move_6.Geometry,
    Amplitude=number_slider_12,
    Frequency=number_slider_13,
    SampleDistance=number_slider_11,
    Seed=Slider(5, range=0..10),
    Smooth=number_slider_17,
    BoundaryMargin=number_slider_11,
    MaxSlope=number_slider_16,
    TopoInfluence=Slider(0.7, range=0..1))  # -> out, Path, Points, Slopes; inputs BaseCurve: Curve, Boundary: Curve, TopoMesh: Mesh, Amplitude: Double, Frequency: Double, SampleDistance: Double, Seed: Int32, Smooth: Double, BoundaryMargin: Double, MaxSlope: Double, TopoInfluence: Double
# ---------- c_script_3: C# ----------
// Grasshopper Script Instance
#region Usings
using System;
using System.Linq;
using System.Collections;
using System.Collections.Generic;

using Rhino;
using Rhino.Geometry;

using Grasshopper;
using Grasshopper.Kernel;
using Grasshopper.Kernel.Data;
using Grasshopper.Kernel.Types;
#endregion

public class Script_Instance : GH_ScriptInstance
{
    private void RunScript(
		Curve BaseCurve,
		Curve Boundary,
		Mesh TopoMesh,
		double Amplitude,
		double Frequency,
		double SampleDistance,
		int Seed,
		double Smooth,
		double BoundaryMargin,
		double MaxSlope,
		double TopoInfluence,
		ref object Path,
		ref object Points,
		ref object Slopes)
    {
        // ====================================================
        // VALIDATION + DEFAULT VALUES
        // ====================================================

        if (BaseCurve == null)
        {
            Print("BaseCurve is null.");
            return;
        }

        if (Boundary == null)
        {
            Print("Boundary is null.");
            return;
        }

        if (TopoMesh == null)
        {
            Print("TopoMesh is null.");
            return;
        }

        if (Amplitude <= 0.0)
            Amplitude = 5.0;

        if (Frequency <= 0.0)
            Frequency = 0.03;

        if (SampleDistance <= 0.0)
            SampleDistance = 2.0;

        if (BoundaryMargin < 0.0)
            BoundaryMargin = 0.0;

        if (MaxSlope <= 0.0)
            MaxSlope = 0.08;

        Smooth = Clamp(Smooth, 0.0, 0.98);
        TopoInfluence = Clamp(TopoInfluence, 0.0, 1.0);

        double tolerance = RhinoDocument.ModelAbsoluteTolerance;

        bool isClosed = BaseCurve.IsClosed;

        Plane boundaryPlane;

        if (!Boundary.TryGetPlane(out boundaryPlane))
            boundaryPlane = Plane.WorldXY;


        // ====================================================
        // CURVE LENGTH + SAMPLE COUNT
        // ====================================================

        double totalLength = BaseCurve.GetLength();

        if (totalLength <= tolerance)
        {
            Print("BaseCurve is too short.");
            return;
        }

        int sampleCount =
            Math.Max(
                isClosed ? 8 : 4,
                (int)Math.Ceiling(totalLength / SampleDistance)
            );

        // Closed:
        // do NOT sample duplicate end point.
        //
        // Open:
        // include both ends.

        List<double> parameters = new List<double>();

        if (isClosed)
        {
            for (int i = 0; i < sampleCount; i++)
            {
                double normalized =
                    (double)i / sampleCount;

                double lengthParameter =
                    normalized * totalLength;

                double t;

                if (BaseCurve.LengthParameter(
                    lengthParameter,
                    out t))
                {
                    parameters.Add(t);
                }
            }
        }
        else
        {
            for (int i = 0; i <= sampleCount; i++)
            {
                double normalized =
                    (double)i / sampleCount;

                double lengthParameter =
                    normalized * totalLength;

                double t;

                if (BaseCurve.LengthParameter(
                    lengthParameter,
                    out t))
                {
                    parameters.Add(t);
                }
            }
        }

        if (parameters.Count < 4)
        {
            Print("Not enough sample points.");
            return;
        }


        // ====================================================
        // SAMPLE BASE CURVE
        // ====================================================

        List<Point3d> basePoints =
            new List<Point3d>();

        List<Vector3d> lateralDirections =
            new List<Vector3d>();

        List<double> distances =
            new List<double>();

        double accumulatedDistance = 0.0;

        for (int i = 0; i < parameters.Count; i++)
        {
            double t = parameters[i];

            Point3d p =
                BaseCurve.PointAt(t);

            Vector3d tangent =
                BaseCurve.TangentAt(t);

            // XY lateral direction
            Vector3d flatTangent =
                new Vector3d(
                    tangent.X,
                    tangent.Y,
                    0.0
                );

            if (!flatTangent.Unitize())
                flatTangent = Vector3d.XAxis;

            Vector3d lateral =
                Vector3d.CrossProduct(
                    Vector3d.ZAxis,
                    flatTangent
                );

            if (!lateral.Unitize())
                lateral = Vector3d.YAxis;

            basePoints.Add(p);
            lateralDirections.Add(lateral);

            if (i > 0)
            {
                accumulatedDistance +=
                    basePoints[i - 1].DistanceTo(
                        basePoints[i]
                    );
            }

            distances.Add(accumulatedDistance);
        }


        // ====================================================
        // GENERATE MEANDER SIGNAL
        // ====================================================

        double[] noise =
            new double[basePoints.Count];

        Random random =
            new Random(Seed);

        if (isClosed)
        {
            // ------------------------------------------------
            // PERIODIC CLOSED NOISE
            //
            // Integer number of cycles guarantees that the
            // waveform closes cleanly around the loop.
            // ------------------------------------------------

            int primaryCycles =
                Math.Max(
                    1,
                    (int)Math.Round(
                        totalLength * Frequency
                    )
                );

            double phase1 =
                random.NextDouble() *
                Math.PI * 2.0;

            double phase2 =
                random.NextDouble() *
                Math.PI * 2.0;

            double phase3 =
                random.NextDouble() *
                Math.PI * 2.0;

            int harmonic2 =
                primaryCycles + 1;

            int harmonic3 =
                Math.Max(
                    1,
                    primaryCycles - 1
                );

            for (int i = 0;
                 i < basePoints.Count;
                 i++)
            {
                double u =
                    (double)i /
                    basePoints.Count;

                double a =
                    Math.Sin(
                        Math.PI * 2.0 *
                        primaryCycles *
                        u +
                        phase1
                    );

                double b =
                    Math.Sin(
                        Math.PI * 2.0 *
                        harmonic2 *
                        u +
                        phase2
                    );

                double c =
                    Math.Sin(
                        Math.PI * 2.0 *
                        harmonic3 *
                        u +
                        phase3
                    );

                noise[i] =
                    a * 0.65 +
                    b * 0.22 +
                    c * 0.13;
            }

            // Cyclic smoothing
            noise =
                SmoothCyclicSignal(
                    noise,
                    Smooth,
                    4
                );
        }
        else
        {
            // ------------------------------------------------
            // OPEN CURVE NOISE
            // ------------------------------------------------

            double[] raw =
                new double[basePoints.Count];

            double phase =
                random.NextDouble() *
                Math.PI * 2.0;

            for (int i = 0;
                 i < basePoints.Count;
                 i++)
            {
                double dist =
                    distances[i];

                double sine =
                    Math.Sin(
                        dist *
                        Frequency *
                        Math.PI * 2.0 +
                        phase
                    );

                double randomPart =
                    random.NextDouble() *
                    2.0 - 1.0;

                raw[i] =
                    sine * 0.75 +
                    randomPart * 0.25;
            }

            noise[0] = raw[0];

            for (int i = 1;
                 i < raw.Length;
                 i++)
            {
                noise[i] =
                    noise[i - 1] * Smooth +
                    raw[i] * (1.0 - Smooth);
            }

            // ------------------------------------------------
            // IMPORTANT:
            // Fade meander to ZERO at ends.
            // ------------------------------------------------

            for (int i = 0;
                 i < noise.Length;
                 i++)
            {
                double u =
                    (double)i /
                    (noise.Length - 1);

                double falloff =
                    Math.Pow(
                        Math.Sin(Math.PI * u),
                        1.5
                    );

                noise[i] *= falloff;
            }

            noise[0] = 0.0;
            noise[noise.Length - 1] = 0.0;
        }


        // ====================================================
        // GENERATE TERRAIN-AWARE CANDIDATE POINTS
        // ====================================================

        List<Point3d> resultPoints =
            new List<Point3d>();

        List<double> slopeValues =
            new List<double>();

        for (int i = 0;
             i < basePoints.Count;
             i++)
        {
            Point3d basePoint =
                basePoints[i];

            Vector3d lateral =
                lateralDirections[i];

            double desiredOffset =
                noise[i] * Amplitude;


            // ================================================
            // OPEN CURVE ENDPOINTS ARE ABSOLUTELY FIXED
            // ================================================

            if (!isClosed &&
                (i == 0 ||
                 i == basePoints.Count - 1))
            {
                resultPoints.Add(basePoint);
                slopeValues.Add(0.0);

                continue;
            }


            // ================================================
            // TEST MULTIPLE LATERAL POSITIONS
            // ================================================

            double[] offsetFactors =
            {
                1.00,
                0.80,
                0.60,
                0.40,
                0.20,
                0.00,
                -0.20,
                -0.40,
                -0.60
            };

            Point3d bestPoint =
                ProjectToMesh(
                    basePoint,
                    TopoMesh
                );

            double bestScore =
                double.MaxValue;

            double bestSlope = 0.0;

            foreach (
                double factor
                in offsetFactors)
            {
                double offset =
                    desiredOffset * factor;

                Point3d candidate =
                    basePoint +
                    lateral * offset;


                // --------------------------------------------
                // BOUNDARY CHECK
                // --------------------------------------------

                candidate =
                    KeepInsideBoundary(
                        candidate,
                        basePoint,
                        Boundary,
                        boundaryPlane,
                        BoundaryMargin,
                        tolerance
                    );


                // --------------------------------------------
                // TERRAIN
                // --------------------------------------------

                Point3d terrainPoint =
                    ProjectToMesh(
                        candidate,
                        TopoMesh
                    );


                // --------------------------------------------
                // LOCAL SLOPE
                // --------------------------------------------

                double slope =
                    EstimateSlope(
                        terrainPoint,
                        TopoMesh,
                        SampleDistance
                    );


                // --------------------------------------------
                // MEANDER PREFERENCE
                // --------------------------------------------

                double offsetError =
                    Math.Abs(
                        offset -
                        desiredOffset
                    );

                double normalizedOffsetError =
                    offsetError /
                    Math.Max(
                        Amplitude,
                        0.001
                    );


                // --------------------------------------------
                // SLOPE PENALTY
                // --------------------------------------------

                double slopePenalty = 0.0;

                if (slope > MaxSlope)
                {
                    double excess =
                        slope -
                        MaxSlope;

                    slopePenalty =
                        excess /
                        Math.Max(
                            MaxSlope,
                            0.001
                        );
                }


                // --------------------------------------------
                // SCORE
                // --------------------------------------------

                double score =
                    normalizedOffsetError *
                    (1.0 - TopoInfluence)
                    +
                    slopePenalty *
                    TopoInfluence;

                if (score < bestScore)
                {
                    bestScore = score;
                    bestPoint = terrainPoint;
                    bestSlope = slope;
                }
            }

            resultPoints.Add(bestPoint);
            slopeValues.Add(bestSlope);
        }


        // ====================================================
        // POSITION SMOOTHING
        // ====================================================

        List<Point3d> smoothed =
            new List<Point3d>(
                resultPoints
            );

        int smoothingPasses = 3;

        for (int pass = 0;
             pass < smoothingPasses;
             pass++)
        {
            List<Point3d> next =
                new List<Point3d>(
                    smoothed
                );

            if (isClosed)
            {
                // --------------------------------------------
                // CYCLIC CLOSED SMOOTHING
                // --------------------------------------------

                for (int i = 0;
                     i < smoothed.Count;
                     i++)
                {
                    int previous =
                        (i - 1 +
                         smoothed.Count) %
                        smoothed.Count;

                    int following =
                        (i + 1) %
                        smoothed.Count;

                    Point3d average =
                        AveragePoints(
                            smoothed[previous],
                            smoothed[i],
                            smoothed[following]
                        );

                    Point3d blended =
                        BlendPoint(
                            smoothed[i],
                            average,
                            0.55
                        );

                    blended =
                        KeepInsideBoundary(
                            blended,
                            basePoints[i],
                            Boundary,
                            boundaryPlane,
                            BoundaryMargin,
                            tolerance
                        );

                    blended =
                        ProjectToMesh(
                            blended,
                            TopoMesh
                        );

                    next[i] =
                        blended;
                }
            }
            else
            {
                // --------------------------------------------
                // OPEN SMOOTHING
                //
                // DON'T MOVE FIRST OR LAST POINT
                // --------------------------------------------

                for (int i = 1;
                     i < smoothed.Count - 1;
                     i++)
                {
                    Point3d average =
                        AveragePoints(
                            smoothed[i - 1],
                            smoothed[i],
                            smoothed[i + 1]
                        );

                    Point3d blended =
                        BlendPoint(
                            smoothed[i],
                            average,
                            0.55
                        );

                    blended =
                        KeepInsideBoundary(
                            blended,
                            basePoints[i],
                            Boundary,
                            boundaryPlane,
                            BoundaryMargin,
                            tolerance
                        );

                    blended =
                        ProjectToMesh(
                            blended,
                            TopoMesh
                        );

                    next[i] =
                        blended;
                }

                // EXACT INPUT CURVE ENDPOINTS
                next[0] =
                    BaseCurve.PointAtStart;

                next[next.Count - 1] =
                    BaseCurve.PointAtEnd;
            }

            smoothed = next;
        }


        // ====================================================
        // FORCE OPEN ENDPOINTS ONE LAST TIME
        // ====================================================

        if (!isClosed)
        {
            smoothed[0] =
                BaseCurve.PointAtStart;

            smoothed[smoothed.Count - 1] =
                BaseCurve.PointAtEnd;
        }


        // ====================================================
        // RECALCULATE OUTPUT SLOPES AFTER SMOOTHING
        // ====================================================

        slopeValues.Clear();

        for (int i = 0;
             i < smoothed.Count;
             i++)
        {
            slopeValues.Add(
                EstimateSlope(
                    smoothed[i],
                    TopoMesh,
                    SampleDistance
                )
            );
        }


        // ====================================================
        // CREATE FINAL CURVE
        // ====================================================

        Curve resultCurve = null;

        if (isClosed)
        {
            // UniformPeriodic generates a smooth closed curve
            // without introducing a seam kink.

            resultCurve =
                Curve.CreateInterpolatedCurve(
                    smoothed,
                    3,
                    CurveKnotStyle.UniformPeriodic
                );
        }
        else
        {
            resultCurve =
                Curve.CreateInterpolatedCurve(
                    smoothed,
                    3,
                    CurveKnotStyle.Chord
                );
        }


        // ====================================================
        // OUTPUTS
        // ====================================================

        Path = resultCurve;
        Points = smoothed;
        Slopes = slopeValues;
    }


    // ========================================================
    // SMOOTH PERIODIC SIGNAL
    // ========================================================

    private double[] SmoothCyclicSignal(
        double[] values,
        double amount,
        int passes)
    {
        double[] current =
            (double[])values.Clone();

        int count =
            current.Length;

        for (int pass = 0;
             pass < passes;
             pass++)
        {
            double[] next =
                new double[count];

            for (int i = 0;
                 i < count;
                 i++)
            {
                int previous =
                    (i - 1 + count) %
                    count;

                int following =
                    (i + 1) %
                    count;

                double average =
                    (
                        current[previous] +
                        current[i] +
                        current[following]
                    ) / 3.0;

                next[i] =
                    current[i] *
                    (1.0 - amount)
                    +
                    average *
                    amount;
            }

            current = next;
        }

        return current;
    }


    // ========================================================
    // PROJECT POINT TO TOPO MESH
    // ========================================================

    private Point3d ProjectToMesh(
        Point3d point,
        Mesh mesh)
    {
        if (mesh == null)
            return point;

        Point3d closest =
            mesh.ClosestPoint(point);

        if (!closest.IsValid)
            return point;

        return closest;
    }


    // ========================================================
    // KEEP GENERATED POINT INSIDE BOUNDARY
    // ========================================================

    private Point3d KeepInsideBoundary(
        Point3d candidate,
        Point3d basePoint,
        Curve boundary,
        Plane plane,
        double margin,
        double tolerance)
    {
        Point3d test =
            candidate;

        // Try progressively pulling the point
        // back toward the original base curve.

        for (int iteration = 0;
             iteration < 25;
             iteration++)
        {
            PointContainment containment =
                boundary.Contains(
                    test,
                    plane,
                    tolerance
                );

            bool inside =
                containment ==
                PointContainment.Inside ||
                containment ==
                PointContainment.Coincident;

            if (inside)
            {
                if (margin <= tolerance)
                    return test;

                double t;

                if (boundary.ClosestPoint(
                    test,
                    out t))
                {
                    Point3d closestBoundary =
                        boundary.PointAt(t);

                    double distanceToBoundary =
                        closestBoundary.DistanceTo(
                            test
                        );

                    if (distanceToBoundary >=
                        margin)
                    {
                        return test;
                    }
                }
            }

            // Pull candidate toward base curve
            test =
                BlendPoint(
                    test,
                    basePoint,
                    0.20
                );
        }


        // If original base point is valid,
        // use that as fallback.

        PointContainment baseContainment =
            boundary.Contains(
                basePoint,
                plane,
                tolerance
            );

        if (
            baseContainment ==
            PointContainment.Inside ||
            baseContainment ==
            PointContainment.Coincident)
        {
            return basePoint;
        }

        return test;
    }


    // ========================================================
    // ESTIMATE TERRAIN SLOPE
    //
    // Returns slope as ratio:
    //
    // 0.08 = approximately 8%
    // ========================================================

    private double EstimateSlope(
        Point3d point,
        Mesh mesh,
        double sampleDistance)
    {
        if (mesh == null)
            return 0.0;

        double d =
            Math.Max(
                sampleDistance,
                0.5
            );

        // Sample terrain in X direction

        Point3d xPlus =
            ProjectToMesh(
                point +
                new Vector3d(
                    d,
                    0,
                    0
                ),
                mesh
            );

        Point3d xMinus =
            ProjectToMesh(
                point +
                new Vector3d(
                    -d,
                    0,
                    0
                ),
                mesh
            );


        // Sample terrain in Y direction

        Point3d yPlus =
            ProjectToMesh(
                point +
                new Vector3d(
                    0,
                    d,
                    0
                ),
                mesh
            );

        Point3d yMinus =
            ProjectToMesh(
                point +
                new Vector3d(
                    0,
                    -d,
                    0
                ),
                mesh
            );


        double dx =
            Math.Sqrt(
                Math.Pow(
                    xPlus.X -
                    xMinus.X,
                    2
                )
                +
                Math.Pow(
                    xPlus.Y -
                    xMinus.Y,
                    2
                )
            );

        double dy =
            Math.Sqrt(
                Math.Pow(
                    yPlus.X -
                    yMinus.X,
                    2
                )
                +
                Math.Pow(
                    yPlus.Y -
                    yMinus.Y,
                    2
                )
            );

        dx =
            Math.Max(
                dx,
                0.001
            );

        dy =
            Math.Max(
                dy,
                0.001
            );

        double dzdx =
            (
                xPlus.Z -
                xMinus.Z
            ) / dx;

        double dzdy =
            (
                yPlus.Z -
                yMinus.Z
            ) / dy;

        return Math.Sqrt(
            dzdx * dzdx +
            dzdy * dzdy
        );
    }


    // ========================================================
    // AVERAGE 3 POINTS
    // ========================================================

    private Point3d AveragePoints(
        Point3d a,
        Point3d b,
        Point3d c)
    {
        return new Point3d(
            (
                a.X +
                b.X +
                c.X
            ) / 3.0,

            (
                a.Y +
                b.Y +
                c.Y
            ) / 3.0,

            (
                a.Z +
                b.Z +
                c.Z
            ) / 3.0
        );
    }


    // ========================================================
    // BLEND TWO POINTS
    //
    // amount = 0 -> A
    // amount = 1 -> B
    // ========================================================

    private Point3d BlendPoint(
        Point3d a,
        Point3d b,
        double amount)
    {
        amount =
            Clamp(
                amount,
                0.0,
                1.0
            );

        return new Point3d(
            a.X +
            (b.X - a.X) *
            amount,

            a.Y +
            (b.Y - a.Y) *
            amount,

            a.Z +
            (b.Z - a.Z) *
            amount
        );
    }


    // ========================================================
    // CLAMP
    // ========================================================

    private double Clamp(
        double value,
        double min,
        double max)
    {
        return Math.Max(
            min,
            Math.Min(
                max,
                value
            )
        );
    }
}
# ---------- end c_script_3 ----------
# ---- group: Calculate catchment bounds
catchments = FlowCatchments(FlowPaths=mesh_flows.FlowPaths, ProximityThreshold=proximity_threshold)  # -> Catchments, FlowPaths, ColorCodes, Volumes

# ----
pt_8 = Point(<point referenced from the Rhino model>)
pt_9 = Point(<point referenced from the Rhino model>)
c_script_4 = CSharpScript(
    BaseCurve=crv_12,
    Boundary=move_4.Geometry,
    TopoMesh=move_6.Geometry,
    PointSpacing=Slider(10, range=0..10),
    Iterations=Slider(40, range=0..1000),
    StepSize=Slider(0.2, range=0..1),
    ExpansionForce=Slider(0.8, range=0..1),
    SpringForce=Slider(0.3, range=0..1),
    SmoothForce=Slider(0.75, range=0..1),
    BoundaryForce=number_slider_15,
    BoundaryMargin=Slider(3, range=0..10),
    SelfRepulsion=number_slider_15,
    RepulsionDistance=Slider(10, range=0..10),
    TargetLength=Slider(1000, range=0..1000),
    LengthForce=Slider(0.8, range=0..1),
    MaxSlope=number_slider_16,
    SlopeForce=Slider(1.5, range=0..10))  # -> out, Path, Points, Length, Slopes; inputs BaseCurve: Curve, Boundary: Curve, TopoMesh: Mesh, PointSpacing: Double, Iterations: Int32, StepSize: Double, ExpansionForce: Double, SpringForce: Double, SmoothForce: Double, BoundaryForce: Double, BoundaryMargin: Double, SelfRepulsion: Double, RepulsionDistance: Double, TargetLength: Double, LengthForce: Double, MaxSlope: Double, SlopeForce: Double
# ---------- c_script_4: C# ----------
// Grasshopper Script Instance
#region Usings
using System;
using System.Linq;
using System.Collections;
using System.Collections.Generic;

using Rhino;
using Rhino.Geometry;

using Grasshopper;
using Grasshopper.Kernel;
using Grasshopper.Kernel.Data;
using Grasshopper.Kernel.Types;
#endregion

public class Script_Instance : GH_ScriptInstance
{
    private void RunScript(
		Curve BaseCurve,
		Curve Boundary,
		Mesh TopoMesh,
		double PointSpacing,
		int Iterations,
		double StepSize,
		double ExpansionForce,
		double SpringForce,
		double SmoothForce,
		double BoundaryForce,
		double BoundaryMargin,
		double SelfRepulsion,
		double RepulsionDistance,
		double TargetLength,
		double LengthForce,
		double MaxSlope,
		double SlopeForce,
		ref object Path,
		ref object Points,
		ref object Length,
		ref object Slopes)
    {
        // ====================================================
        // VALIDATION / DEFAULTS
        // ====================================================

        if (BaseCurve == null)
        {
            Print("BaseCurve is null.");
            return;
        }

        if (Boundary == null)
        {
            Print("Boundary is null.");
            return;
        }

        if (TopoMesh == null)
        {
            Print("TopoMesh is null.");
            return;
        }

        if (PointSpacing <= 0)
            PointSpacing = 3.0;

        if (Iterations <= 0)
            Iterations = 150;

        if (StepSize <= 0)
            StepSize = 0.25;

        if (ExpansionForce < 0)
            ExpansionForce = 1.0;

        if (SpringForce < 0)
            SpringForce = 0.5;

        if (SmoothForce < 0)
            SmoothForce = 0.8;

        if (BoundaryForce < 0)
            BoundaryForce = 2.0;

        if (BoundaryMargin < 0)
            BoundaryMargin = 3.0;

        if (SelfRepulsion < 0)
            SelfRepulsion = 1.0;

        if (RepulsionDistance <= 0)
            RepulsionDistance = 8.0;

        if (TargetLength <= 0)
            TargetLength = BaseCurve.GetLength();

        if (LengthForce < 0)
            LengthForce = 0.5;

        if (MaxSlope <= 0)
            MaxSlope = 0.08;

        if (SlopeForce < 0)
            SlopeForce = 1.0;

        double tolerance =
            RhinoDocument.ModelAbsoluteTolerance;

        bool isClosed =
            BaseCurve.IsClosed;

        Plane boundaryPlane;

        if (!Boundary.TryGetPlane(out boundaryPlane))
            boundaryPlane = Plane.WorldXY;


        // ====================================================
        // RESAMPLE INPUT CURVE
        // ====================================================

        double originalLength =
            BaseCurve.GetLength();

        int segmentCount =
            Math.Max(
                isClosed ? 12 : 4,
                (int)Math.Ceiling(
                    originalLength /
                    PointSpacing
                )
            );

        List<Point3d> points =
            ResampleCurve(
                BaseCurve,
                segmentCount,
                isClosed
            );

        if (points.Count < 4)
        {
            Print("Not enough points.");
            return;
        }


        // ====================================================
        // PROJECT INITIAL POINTS TO TERRAIN
        // ====================================================

        for (int i = 0; i < points.Count; i++)
        {
            if (!isClosed &&
                (i == 0 || i == points.Count - 1))
                continue;

            Point3d p =
                ProjectToMesh(
                    points[i],
                    TopoMesh
                );

            p =
                KeepInsideBoundary(
                    p,
                    points[i],
                    Boundary,
                    boundaryPlane,
                    BoundaryMargin,
                    tolerance
                );

            points[i] = p;
        }


        // ====================================================
        // FIXED OPEN ENDPOINTS
        // ====================================================

        Point3d fixedStart =
            BaseCurve.PointAtStart;

        Point3d fixedEnd =
            BaseCurve.PointAtEnd;


        // ====================================================
        // INITIAL REST LENGTH
        // ====================================================

        double restLength =
            TargetLength /
            (
                isClosed
                ? points.Count
                : points.Count - 1
            );


        // ====================================================
        // ITERATIVE RUBBER-BAND SOLVER
        // ====================================================

        for (int iteration = 0;
             iteration < Iterations;
             iteration++)
        {
            int count =
                points.Count;

            Vector3d[] forces =
                new Vector3d[count];

            for (int i = 0; i < count; i++)
                forces[i] = Vector3d.Zero;


            // ================================================
            // CURRENT CENTROID
            // ================================================

            Point3d centroid =
                ComputeCentroid(points);


            // ================================================
            // CURRENT LENGTH
            // ================================================

            double currentLength =
                PolylineLength(
                    points,
                    isClosed
                );

            double lengthDifference =
                TargetLength -
                currentLength;

            double normalizedLengthDifference =
                lengthDifference /
                Math.Max(
                    TargetLength,
                    0.001
                );


            // ================================================
            // FORCES PER POINT
            // ================================================

            for (int i = 0;
                 i < count;
                 i++)
            {
                // --------------------------------------------
                // OPEN ENDPOINTS ARE LOCKED
                // --------------------------------------------

                if (!isClosed &&
                    (i == 0 ||
                     i == count - 1))
                {
                    continue;
                }


                int previous =
                    isClosed
                    ? (i - 1 + count) % count
                    : i - 1;

                int next =
                    isClosed
                    ? (i + 1) % count
                    : i + 1;

                if (previous < 0 ||
                    next >= count)
                    continue;


                Point3d p =
                    points[i];

                Point3d pPrev =
                    points[previous];

                Point3d pNext =
                    points[next];


                // ============================================
                // 1. SPACE-FILLING EXPANSION
                // ============================================

                Vector3d outward =
                    p - centroid;

                outward.Z = 0;

                if (outward.Unitize())
                {
                    double expansionScale =
                        ExpansionForce;

                    // Target length controls whether
                    // expansion is encouraged or reduced.

                    double lengthMultiplier =
                        1.0 +
                        normalizedLengthDifference *
                        LengthForce;

                    expansionScale *=
                        Math.Max(
                            0.0,
                            lengthMultiplier
                        );

                    forces[i] +=
                        outward *
                        expansionScale;
                }


                // ============================================
                // 2. SPRING FORCE
                //
                // tries to keep approximately equal spacing
                // ============================================

                AddSpringForce(
                    ref forces[i],
                    p,
                    pPrev,
                    restLength,
                    SpringForce
                );

                AddSpringForce(
                    ref forces[i],
                    p,
                    pNext,
                    restLength,
                    SpringForce
                );


                // ============================================
                // 3. SMOOTHING / BENDING FORCE
                // ============================================

                Point3d midpoint =
                    new Point3d(
                        (pPrev.X + pNext.X) * 0.5,
                        (pPrev.Y + pNext.Y) * 0.5,
                        (pPrev.Z + pNext.Z) * 0.5
                    );

                Vector3d smoothing =
                    midpoint - p;

                forces[i] +=
                    smoothing *
                    SmoothForce;


                // ============================================
                // 4. BOUNDARY REPULSION
                // ============================================

                double boundaryT;

                if (Boundary.ClosestPoint(
                    p,
                    out boundaryT))
                {
                    Point3d closest =
                        Boundary.PointAt(
                            boundaryT
                        );

                    Vector3d away =
                        p - closest;

                    away.Z = 0;

                    double distance =
                        away.Length;

                    if (distance <
                        BoundaryMargin * 2.0)
                    {
                        if (!away.Unitize())
                        {
                            away =
                                p - centroid;

                            away.Z = 0;
                            away.Unitize();
                        }

                        double normalized =
                            1.0 -
                            Clamp(
                                distance /
                                Math.Max(
                                    BoundaryMargin * 2.0,
                                    0.001
                                ),
                                0.0,
                                1.0
                            );

                        forces[i] +=
                            away *
                            normalized *
                            BoundaryForce;
                    }
                }


                // ============================================
                // 5. SELF REPULSION
                // ============================================

                for (int j = 0;
                     j < count;
                     j++)
                {
                    if (j == i)
                        continue;

                    // Ignore immediate neighbours.
                    // They need to stay connected.

                    int indexDistance =
                        Math.Abs(i - j);

                    if (isClosed)
                    {
                        indexDistance =
                            Math.Min(
                                indexDistance,
                                count - indexDistance
                            );
                    }

                    if (indexDistance <= 2)
                        continue;


                    Vector3d separation =
                        p - points[j];

                    separation.Z = 0;

                    double distance =
                        separation.Length;

                    if (distance <= 0.001)
                        continue;

                    if (distance <
                        RepulsionDistance)
                    {
                        separation.Unitize();

                        double normalized =
                            1.0 -
                            distance /
                            RepulsionDistance;

                        // Stronger as curves get closer.

                        normalized *=
                            normalized;

                        forces[i] +=
                            separation *
                            normalized *
                            SelfRepulsion;
                    }
                }


                // ============================================
                // 6. SLOPE AVOIDANCE
                // ============================================

                Vector3d slopeDirection;
                double slope;

                GetSlopeGradient(
                    p,
                    TopoMesh,
                    PointSpacing,
                    out slopeDirection,
                    out slope
                );

                if (slope >
                    MaxSlope &&
                    slopeDirection.Length > 0)
                {
                    // slopeDirection points uphill.
                    // Move opposite = downhill/flatter.

                    slopeDirection.Unitize();

                    double excess =
                        (slope - MaxSlope) /
                        Math.Max(
                            MaxSlope,
                            0.001
                        );

                    forces[i] +=
                        -slopeDirection *
                        excess *
                        SlopeForce;
                }
            }


            // ================================================
            // APPLY FORCES
            // ================================================

            List<Point3d> nextPoints =
                new List<Point3d>(points);

            for (int i = 0;
                 i < count;
                 i++)
            {
                if (!isClosed &&
                    (i == 0 ||
                     i == count - 1))
                {
                    continue;
                }

                Vector3d force =
                    forces[i];

                // Prevent unstable giant jumps.

                double maxForce = 10.0;

                if (force.Length >
                    maxForce)
                {
                    force.Unitize();

                    force *=
                        maxForce;
                }

                Point3d candidate =
                    points[i] +
                    force *
                    StepSize;


                // ============================================
                // KEEP IN BOUNDARY
                // ============================================

                candidate =
                    KeepInsideBoundary(
                        candidate,
                        points[i],
                        Boundary,
                        boundaryPlane,
                        BoundaryMargin,
                        tolerance
                    );


                // ============================================
                // PROJECT BACK TO TERRAIN
                // ============================================

                candidate =
                    ProjectToMesh(
                        candidate,
                        TopoMesh
                    );


                // Check once again after mesh projection

                candidate =
                    KeepInsideBoundary(
                        candidate,
                        points[i],
                        Boundary,
                        boundaryPlane,
                        BoundaryMargin,
                        tolerance
                    );

                nextPoints[i] =
                    candidate;
            }


            // ================================================
            // LOCK OPEN CURVE ENDS
            // ================================================

            if (!isClosed)
            {
                nextPoints[0] =
                    fixedStart;

                nextPoints[
                    nextPoints.Count - 1
                ] =
                    fixedEnd;
            }

            points =
                nextPoints;
        }


        // ====================================================
        // FINAL CLEANUP SMOOTHING
        // ====================================================

        points =
            SmoothPoints(
                points,
                isClosed,
                BaseCurve,
                Boundary,
                boundaryPlane,
                TopoMesh,
                BoundaryMargin,
                tolerance,
                2
            );


        // ====================================================
        // FORCE OPEN ENDPOINTS
        // ====================================================

        if (!isClosed)
        {
            points[0] =
                fixedStart;

            points[
                points.Count - 1
            ] =
                fixedEnd;
        }


        // ====================================================
        // CREATE FINAL CURVE
        // ====================================================

        Curve result = null;

        if (isClosed)
        {
            result =
                Curve.CreateInterpolatedCurve(
                    points,
                    3,
                    CurveKnotStyle.UniformPeriodic
                );
        }
        else
        {
            result =
                Curve.CreateInterpolatedCurve(
                    points,
                    3,
                    CurveKnotStyle.Chord
                );
        }


        // ====================================================
        // OUTPUT SLOPE VALUES
        // ====================================================

        List<double> slopeValues =
            new List<double>();

        for (int i = 0;
             i < points.Count;
             i++)
        {
            Vector3d gradient;
            double slope;

            GetSlopeGradient(
                points[i],
                TopoMesh,
                PointSpacing,
                out gradient,
                out slope
            );

            slopeValues.Add(
                slope
            );
        }


        // ====================================================
        // OUTPUT
        // ====================================================

        Path = result;

        Points = points;

        Length =
            result != null
            ? result.GetLength()
            : 0.0;

        Slopes =
            slopeValues;
    }


    // ========================================================
    // RESAMPLE CURVE
    // ========================================================

    private List<Point3d> ResampleCurve(
        Curve curve,
        int segments,
        bool closed)
    {
        List<Point3d> result =
            new List<Point3d>();

        double length =
            curve.GetLength();

        if (closed)
        {
            for (int i = 0;
                 i < segments;
                 i++)
            {
                double fraction =
                    (double)i /
                    segments;

                double targetLength =
                    length *
                    fraction;

                double t;

                if (curve.LengthParameter(
                    targetLength,
                    out t))
                {
                    result.Add(
                        curve.PointAt(t)
                    );
                }
            }
        }
        else
        {
            for (int i = 0;
                 i <= segments;
                 i++)
            {
                double fraction =
                    (double)i /
                    segments;

                double targetLength =
                    length *
                    fraction;

                double t;

                if (curve.LengthParameter(
                    targetLength,
                    out t))
                {
                    result.Add(
                        curve.PointAt(t)
                    );
                }
            }
        }

        return result;
    }


    // ========================================================
    // SPRING
    // ========================================================

    private void AddSpringForce(
        ref Vector3d totalForce,
        Point3d point,
        Point3d neighbour,
        double restLength,
        double strength)
    {
        Vector3d direction =
            neighbour -
            point;

        double length =
            direction.Length;

        if (length <= 0.0001)
            return;

        direction.Unitize();

        double difference =
            length -
            restLength;

        totalForce +=
            direction *
            difference *
            strength;
    }


    // ========================================================
    // CENTROID
    // ========================================================

    private Point3d ComputeCentroid(
        List<Point3d> pts)
    {
        double x = 0;
        double y = 0;
        double z = 0;

        foreach (Point3d p in pts)
        {
            x += p.X;
            y += p.Y;
            z += p.Z;
        }

        double count =
            Math.Max(
                pts.Count,
                1
            );

        return new Point3d(
            x / count,
            y / count,
            z / count
        );
    }


    // ========================================================
    // POLYLINE LENGTH
    // ========================================================

    private double PolylineLength(
        List<Point3d> pts,
        bool closed)
    {
        double length = 0;

        for (int i = 0;
             i < pts.Count - 1;
             i++)
        {
            length +=
                pts[i].DistanceTo(
                    pts[i + 1]
                );
        }

        if (closed &&
            pts.Count > 2)
        {
            length +=
                pts[
                    pts.Count - 1
                ].DistanceTo(
                    pts[0]
                );
        }

        return length;
    }


    // ========================================================
    // PROJECT TO MESH
    // ========================================================

    private Point3d ProjectToMesh(
        Point3d point,
        Mesh mesh)
    {
        if (mesh == null)
            return point;

        Point3d p =
            mesh.ClosestPoint(
                point
            );

        if (!p.IsValid)
            return point;

        return p;
    }


    // ========================================================
    // KEEP INSIDE BOUNDARY
    // ========================================================

    private Point3d KeepInsideBoundary(
        Point3d candidate,
        Point3d fallback,
        Curve boundary,
        Plane plane,
        double margin,
        double tolerance)
    {
        Point3d p =
            candidate;

        for (int i = 0;
             i < 30;
             i++)
        {
            PointContainment containment =
                boundary.Contains(
                    p,
                    plane,
                    tolerance
                );

            bool inside =
                containment ==
                PointContainment.Inside ||
                containment ==
                PointContainment.Coincident;

            if (inside)
            {
                if (margin <= tolerance)
                    return p;

                double t;

                if (boundary.ClosestPoint(
                    p,
                    out t))
                {
                    Point3d boundaryPoint =
                        boundary.PointAt(t);

                    double distance =
                        p.DistanceTo(
                            boundaryPoint
                        );

                    if (distance >=
                        margin)
                    {
                        return p;
                    }
                }
            }

            // Move toward previously valid point.

            p =
                Blend(
                    p,
                    fallback,
                    0.25
                );
        }

        return fallback;
    }


    // ========================================================
    // TERRAIN SLOPE GRADIENT
    // ========================================================

    private void GetSlopeGradient(
        Point3d point,
        Mesh mesh,
        double distance,
        out Vector3d gradient,
        out double slope)
    {
        gradient =
            Vector3d.Zero;

        slope = 0.0;

        if (mesh == null)
            return;

        double d =
            Math.Max(
                distance,
                0.5
            );


        Point3d xp =
            ProjectToMesh(
                point +
                new Vector3d(
                    d,
                    0,
                    0
                ),
                mesh
            );

        Point3d xm =
            ProjectToMesh(
                point +
                new Vector3d(
                    -d,
                    0,
                    0
                ),
                mesh
            );

        Point3d yp =
            ProjectToMesh(
                point +
                new Vector3d(
                    0,
                    d,
                    0
                ),
                mesh
            );

        Point3d ym =
            ProjectToMesh(
                point +
                new Vector3d(
                    0,
                    -d,
                    0
                ),
                mesh
            );


        double dx =
            Math.Max(
                Math.Sqrt(
                    Math.Pow(
                        xp.X - xm.X,
                        2
                    ) +
                    Math.Pow(
                        xp.Y - xm.Y,
                        2
                    )
                ),
                0.001
            );

        double dy =
            Math.Max(
                Math.Sqrt(
                    Math.Pow(
                        yp.X - ym.X,
                        2
                    ) +
                    Math.Pow(
                        yp.Y - ym.Y,
                        2
                    )
                ),
                0.001
            );


        double dzdx =
            (xp.Z - xm.Z) /
            dx;

        double dzdy =
            (yp.Z - ym.Z) /
            dy;


        slope =
            Math.Sqrt(
                dzdx * dzdx +
                dzdy * dzdy
            );


        gradient =
            new Vector3d(
                dzdx,
                dzdy,
                0
            );
    }


    // ========================================================
    // FINAL SMOOTHING
    // ========================================================

    private List<Point3d> SmoothPoints(
        List<Point3d> pts,
        bool closed,
        Curve baseCurve,
        Curve boundary,
        Plane boundaryPlane,
        Mesh mesh,
        double margin,
        double tolerance,
        int passes)
    {
        List<Point3d> current =
            new List<Point3d>(pts);

        int count =
            current.Count;

        for (int pass = 0;
             pass < passes;
             pass++)
        {
            List<Point3d> next =
                new List<Point3d>(
                    current
                );

            for (int i = 0;
                 i < count;
                 i++)
            {
                if (!closed &&
                    (i == 0 ||
                     i == count - 1))
                    continue;


                int previous =
                    closed
                    ? (i - 1 + count) % count
                    : i - 1;

                int following =
                    closed
                    ? (i + 1) % count
                    : i + 1;

                if (previous < 0 ||
                    following >= count)
                    continue;


                Point3d average =
                    new Point3d(
                        (
                            current[previous].X +
                            current[i].X +
                            current[following].X
                        ) / 3.0,

                        (
                            current[previous].Y +
                            current[i].Y +
                            current[following].Y
                        ) / 3.0,

                        (
                            current[previous].Z +
                            current[i].Z +
                            current[following].Z
                        ) / 3.0
                    );


                Point3d candidate =
                    Blend(
                        current[i],
                        average,
                        0.5
                    );


                candidate =
                    KeepInsideBoundary(
                        candidate,
                        current[i],
                        boundary,
                        boundaryPlane,
                        margin,
                        tolerance
                    );


                candidate =
                    ProjectToMesh(
                        candidate,
                        mesh
                    );

                next[i] =
                    candidate;
            }

            current =
                next;
        }


        if (!closed)
        {
            current[0] =
                baseCurve.PointAtStart;

            current[
                current.Count - 1
            ] =
                baseCurve.PointAtEnd;
        }

        return current;
    }


    // ========================================================
    // BLEND
    // ========================================================

    private Point3d Blend(
        Point3d a,
        Point3d b,
        double t)
    {
        t =
            Clamp(
                t,
                0,
                1
            );

        return new Point3d(
            a.X +
            (b.X - a.X) * t,

            a.Y +
            (b.Y - a.Y) * t,

            a.Z +
            (b.Z - a.Z) * t
        );
    }


    // ========================================================
    // CLAMP
    // ========================================================

    private double Clamp(
        double value,
        double min,
        double max)
    {
        return Math.Max(
            min,
            Math.Min(
                max,
                value
            )
        );
    }
}
# ---------- end c_script_4 ----------
random = Random(Range=construct_domain, Number=number_slider_14, Seed=2)
circle = CircleCNR(Center=populate_geometry, Normal=Vector(0, 0, 1), Radius=Slider(7, range=0..100))
item_2 = ListItem(List=eval.Point, Index=0, Wrap=True)  # -> Item, Item1, Item2
parkcirculation = GenerateCirculation(
    Boundary=parkbubbles.ResolvedBoundary,
    ProgramPolygons=c_script_2.Cells,
    ProgramIDs=parkbubbles.AreaProgramIDs,
    MainEntrance=item_2.Item2,
    DesignPackage=design_package_5,
    CellSize=2,
    RouteReuse=0.35,
    Run=run_6,
    Smoothness=0.65,
    PolygonMode="AUTO",
    MaximumTerritoryFill=0.75)  # -> PrimaryPaths, SecondaryPaths, TertiaryPaths, ServicePaths, AccessCandidates, SelectedAccess, GraphNodes, BlockedGridCells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
crv_16 = Curve([parkcirculation.PrimaryPaths, parkcirculation.SecondaryPaths, parkcirculation.TertiaryPaths])
circle_2 = CircleCNR(Center=pop2d_2, Normal=Vector(0, 0, 1), Radius=random)
item_3 = ListItem(List=eval.Point, Index=0, Wrap=True)  # -> Item, Item1, Item2, Item3
cluster_2 = Cluster_2(crv=c_script_3.Path)  # -> L, crv_3
pooling_color = ColourSwatch(SwatchColor=RGB(255, 255, 255))
number_slider_21 = Slider(2, range=0..10)
crv_17 = Curve(c_script_4.Path)
pline = PolyLine(Vertices=[item_3.Item, item_3.Item1], Closed=False)
rubberband1_2 = RubberBand1(Circles=circle_2, SortCircles=toggle)
c_script_5 = CSharpScript(
    BaseCurve=rubberband1_2,
    Boundary=move_4.Geometry,
    TopoMesh=move_6.Geometry,
    Amplitude=Slider(3, range=0..5),
    Frequency=Slider(0.015, range=0..0.03),
    SampleDistance=Slider(7, range=0..100),
    Seed=Slider(5, range=0..10),
    Smooth=Slider(1, range=0..1),
    BoundaryMargin=Slider(10, range=0..10),
    MaxSlope=Slider(0.04, range=0..0.1),
    TopoInfluence=Slider(0.7, range=0..1))  # -> out, Path, Points, Slopes; inputs BaseCurve: Curve, Boundary: Curve, TopoMesh: Mesh, Amplitude: Double, Frequency: Double, SampleDistance: Double, Seed: Int32, Smooth: Double, BoundaryMargin: Double, MaxSlope: Double, TopoInfluence: Double; same code as c_script_3
pline_2 = PolyLine(Vertices=[item_3.Item3, item_3.Item2], Closed=False)
colours = Data(catchments.ColorCodes)
flow_paths = Curve(catchments.FlowPaths)

# ---- group: Find average endpoint within a catchment
flow_paths_2 = Curve(catchments.FlowPaths)
end = EndPoints(Curve=flow_paths_2)  # -> Start, End
pdecon = Deconstruct(Point=end.End)  # -> XComponent, YComponent, ZComponent
lng = ListLength(List=pdecon.XComponent)
ma = MassAddition(Input=pdecon.YComponent)  # -> Result, PartialResults
ma_2 = MassAddition(Input=pdecon.XComponent)  # -> Result, PartialResults
ma_3 = MassAddition(Input=pdecon.ZComponent)  # -> Result, PartialResults
division = Division(A=ma_3.Result, B=lng)
division_2 = Division(A=ma_2.Result, B=lng)
division_3 = Division(A=ma.Result, B=lng)
pt_10 = ConstructPoint(XCoordinate=division_2, YCoordinate=division_3, ZCoordinate=division)

# ---- group: Label each catchment center by the volume of water collected
colours_2 = Data(catchments.ColorCodes)
flow_volumes = Number(catchments.Volumes)
flow_volumes_total = Number(total_flow_volume_total)
multiplication = Multiplication(A=flow_volumes, B=flow_volumes_total)
round = Round(Number=multiplication)  # -> Nearest, Floor, Ceiling
concat = Concatenate(FragmentA=round.Nearest, FragmentB=" litres")
label_szie = Slider(5, range=0..100)
label_color = ColourSwatch(SwatchColor=RGB(255, 255, 255))
preview = CustomPreview(Geometry=pt_10, Material=colours_2)
tag_2 = TextTag3D(Location=pt_10, Text=concat, Size=label_szie, Colour=label_color, Justification=7)

# ----
catchments_2 = Data(catchments.Catchments)
rubberband1_3 = RubberBand1(Circles=circle, SortCircles=toggle)
preview_2 = CustomPreview(Geometry=mesh_flows.FlowPaths, Shader=pooling_color)
join = JoinCurves(Curves=[cluster_2.L, cluster_2.crv_3], Preserve=False)
cluster_3 = Cluster_2(crv=c_script_5.Path)  # -> L, crv_3
midpt = CurveMiddle(Curve=pline)
len = Length(Curve=join)
length = Length(Curve=rubberband1_2)
join_2 = JoinCurves(Curves=[cluster_3.L, cluster_3.crv_3], Preserve=False)
number_slider_22 = Slider(0, range=0..100)
galapagos = Galapagos(fitness=num, gene=[genes, number_slider_12, number_slider_13, number_slider_11, number_slider_17])
subtraction = Subtraction(A=Slider(1000, range=0..1000), B=len)
ln = Line(StartPoint=midpt, EndPoint=item_3.Item2)
num = Number(subtraction)
crv_18 = Curve([pline, pline_2])
crv_19 = Curve(crv_18)
merge_3 = Merge(Data2=crv_19)  # -> flatten(Result)
crv_20 = Curve(merge_3)
mcx = MultipleCurves(Curves=crv_20)  # -> Points, IndexA, IndexB, ParamA, ParamB
shatter = Shatter(Curve=crv_20, Parameters=mcx.ParamA)
explode_2 = Explode(Curve=merge_3, Recursive=True)  # -> flatten(Segments), Vertices
mcx_2 = MultipleCurves(Curves=explode_2.Segments)  # -> Points, IndexA, IndexB, ParamA, ParamB
ln_2 = Line(StartPoint=flatten(explode_2.Vertices), EndPoint=mcx_2.Points)
end_2 = EndPoints(Curve=ln_2)  # -> Start, End
c_script_6 = CSharpScript(
    Boundary=parkbubbles.ResolvedBoundary,
    Obstacles=scale_5.Geometry,
    Start=end_2.Start,
    End=end_2.End,
    CellSize=Slider(3, range=0..10),
    Buffer=Slider(0, range=0..10))  # -> out, Path, Grid, Times; inputs Boundary: Curve, Obstacles: list of Curve, Start: Point3d, End: Point3d, CellSize: Double, Buffer: Double
# ---------- c_script_6: C# ----------
// Grasshopper Script Instance
#region Usings
using System;
using System.Linq;
using System.Collections;
using System.Collections.Generic;
using System.Drawing;

using Rhino;
using Rhino.Geometry;

using Grasshopper;
using Grasshopper.Kernel;
using Grasshopper.Kernel.Data;
using Grasshopper.Kernel.Types;
#endregion

public class Script_Instance : GH_ScriptInstance
{
    private void RunScript(
		Curve Boundary,
		List<Curve> Obstacles,
		Point3d Start,
		Point3d End,
		double CellSize,
		double Buffer,
		ref object Path,
		ref object Grid,
		ref object Times)
    {
        if (Boundary == null)
            return;

        if (CellSize <= 0)
            CellSize = 1.0;

        BoundingBox bb = Boundary.GetBoundingBox(true);

        int nx = (int)Math.Ceiling(
            (bb.Max.X - bb.Min.X) / CellSize) + 1;

        int ny = (int)Math.Ceiling(
            (bb.Max.Y - bb.Min.Y) / CellSize) + 1;

        Node[,] nodes = new Node[nx, ny];

        List<Point3d> gridPoints = new List<Point3d>();
        List<double> travelTimes = new List<double>();

        Plane plane = Plane.WorldXY;

        // ----------------------------------------------------
        // BUILD GRID
        // ----------------------------------------------------

        for (int i = 0; i < nx; i++)
        {
            for (int j = 0; j < ny; j++)
            {
                Point3d p = new Point3d(
                    bb.Min.X + i * CellSize,
                    bb.Min.Y + j * CellSize,
                    0
                );

                Node n = new Node();

                n.I = i;
                n.J = j;
                n.P = p;

                n.Time = double.MaxValue;
                n.Blocked = false;
                n.Visited = false;

                // Outside boundary
                PointContainment siteContainment =
                    Boundary.Contains(
                        p,
                        plane,
                        RhinoDoc.ActiveDoc.ModelAbsoluteTolerance
                    );

                if (siteContainment == PointContainment.Outside)
                {
                    n.Blocked = true;
                }

                // Check obstacles
                if (!n.Blocked && Obstacles != null)
                {
                    foreach (Curve obstacle in Obstacles)
                    {
                        if (obstacle == null)
                            continue;

                        PointContainment c =
                            obstacle.Contains(
                                p,
                                plane,
                                RhinoDoc.ActiveDoc.ModelAbsoluteTolerance
                            );

                        if (c == PointContainment.Inside)
                        {
                            n.Blocked = true;
                            break;
                        }

                        // Buffer
                        if (Buffer > 0)
                        {
                            double t;

                            if (obstacle.ClosestPoint(p, out t))
                            {
                                Point3d cp = obstacle.PointAt(t);

                                if (cp.DistanceTo(p) < Buffer)
                                {
                                    n.Blocked = true;
                                    break;
                                }
                            }
                        }
                    }
                }

                nodes[i, j] = n;

                if (!n.Blocked)
                    gridPoints.Add(p);
            }
        }

        // ----------------------------------------------------
        // FIND END NODE
        // ----------------------------------------------------

        Node endNode = FindClosestValid(nodes, End);

        if (endNode == null)
        {
            Print("Could not find a valid End node.");
            return;
        }

        endNode.Time = 0;

        // ----------------------------------------------------
        // PROPAGATE TRAVEL FIELD
        // ----------------------------------------------------

        MinHeap heap = new MinHeap();

        heap.Push(endNode);

        int[,] directions =
        {
            {-1,-1},
            { 0,-1},
            { 1,-1},

            {-1, 0},
            { 1, 0},

            {-1, 1},
            { 0, 1},
            { 1, 1}
        };

        while (heap.Count > 0)
        {
            Node current = heap.Pop();

            if (current.Visited)
                continue;

            current.Visited = true;

            for (int d = 0; d < 8; d++)
            {
                int ii = current.I + directions[d, 0];
                int jj = current.J + directions[d, 1];

                if (
                    ii < 0 ||
                    jj < 0 ||
                    ii >= nx ||
                    jj >= ny
                )
                    continue;

                Node next = nodes[ii, jj];

                if (next == null)
                    continue;

                if (next.Blocked)
                    continue;

                if (next.Visited)
                    continue;

                double distance =
                    current.P.DistanceTo(next.P);

                double newTime =
                    current.Time + distance;

                if (newTime < next.Time)
                {
                    next.Time = newTime;

                    heap.Push(next);
                }
            }
        }

        // ----------------------------------------------------
        // FIND START
        // ----------------------------------------------------

        Node startNode =
            FindClosestValid(nodes, Start);

        if (startNode == null)
        {
            Print("Could not find a valid Start node.");
            return;
        }

        // ----------------------------------------------------
        // TRACE DOWNHILL THROUGH FIELD
        // ----------------------------------------------------

        List<Point3d> pathPoints =
            new List<Point3d>();

        Node walker = startNode;

        int maxIterations =
            nx * ny;

        int iterations = 0;

        while (
            walker != null &&
            iterations < maxIterations)
        {
            pathPoints.Add(walker.P);

            if (walker == endNode)
                break;

            Node best = null;

            double bestTime =
                walker.Time;

            for (int d = 0; d < 8; d++)
            {
                int ii =
                    walker.I + directions[d, 0];

                int jj =
                    walker.J + directions[d, 1];

                if (
                    ii < 0 ||
                    jj < 0 ||
                    ii >= nx ||
                    jj >= ny
                )
                    continue;

                Node candidate =
                    nodes[ii, jj];

                if (candidate == null)
                    continue;

                if (candidate.Blocked)
                    continue;

                if (candidate.Time < bestTime)
                {
                    bestTime =
                        candidate.Time;

                    best =
                        candidate;
                }
            }

            if (best == null)
                break;

            walker = best;

            iterations++;
        }

        // ----------------------------------------------------
        // CREATE PATH CURVE
        // ----------------------------------------------------

        Curve resultPath = null;

        if (pathPoints.Count >= 4)
        {
            resultPath =
                Curve.CreateInterpolatedCurve(
                    pathPoints,
                    3
                );
        }
        else if (pathPoints.Count >= 2)
        {
            resultPath =
                new PolylineCurve(pathPoints);
        }

        // ----------------------------------------------------
        // TRAVEL TIME OUTPUT
        // ----------------------------------------------------

        foreach (Point3d p in gridPoints)
        {
            Node n =
                FindClosestValid(nodes, p);

            if (n != null)
                travelTimes.Add(n.Time);
        }

        Path = resultPath;
        Grid = gridPoints;
        Times = travelTimes;
    }


    // ========================================================
    // NODE CLASS
    // ========================================================

    private class Node
    {
        public int I;
        public int J;

        public Point3d P;

        public double Time;

        public bool Blocked;
        public bool Visited;
    }


    // ========================================================
    // FIND CLOSEST VALID NODE
    // ========================================================

    private Node FindClosestValid(
        Node[,] nodes,
        Point3d target)
    {
        Node closest = null;

        double bestDistance =
            double.MaxValue;

        int nx =
            nodes.GetLength(0);

        int ny =
            nodes.GetLength(1);

        for (int i = 0; i < nx; i++)
        {
            for (int j = 0; j < ny; j++)
            {
                Node n =
                    nodes[i, j];

                if (n == null)
                    continue;

                if (n.Blocked)
                    continue;

                double d =
                    n.P.DistanceToSquared(target);

                if (d < bestDistance)
                {
                    bestDistance =
                        d;

                    closest =
                        n;
                }
            }
        }

        return closest;
    }


    // ========================================================
    // MIN HEAP
    // ========================================================

    private class MinHeap
    {
        private List<Node> data =
            new List<Node>();

        public int Count
        {
            get
            {
                return data.Count;
            }
        }

        public void Push(Node node)
        {
            data.Add(node);

            int index =
                data.Count - 1;

            while (index > 0)
            {
                int parent =
                    (index - 1) / 2;

                if (
                    data[parent].Time <=
                    data[index].Time
                )
                    break;

                Node temp =
                    data[index];

                data[index] =
                    data[parent];

                data[parent] =
                    temp;

                index =
                    parent;
            }
        }

        public Node Pop()
        {
            if (data.Count == 0)
                return null;

            Node root =
                data[0];

            Node last =
                data[data.Count - 1];

            data.RemoveAt(
                data.Count - 1
            );

            if (data.Count == 0)
                return root;

            data[0] =
                last;

            int index =
                0;

            while (true)
            {
                int left =
                    index * 2 + 1;

                int right =
                    index * 2 + 2;

                int smallest =
                    index;

                if (
                    left < data.Count &&
                    data[left].Time <
                    data[smallest].Time
                )
                {
                    smallest =
                        left;
                }

                if (
                    right < data.Count &&
                    data[right].Time <
                    data[smallest].Time
                )
                {
                    smallest =
                        right;
                }

                if (smallest == index)
                    break;

                Node temp =
                    data[index];

                data[index] =
                    data[smallest];

                data[smallest] =
                    temp;

                index =
                    smallest;
            }

            return root;
        }
    }
}
# ---------- end c_script_6 ----------
crv_21 = Curve(c_script_6.Path)
smoothpline = SmoothPolyline(Polyline=c_script_6.Path, Strength=1, Times=1)
reb = RebuildCurve(Curve=crv_21, Count=Slider(5, range=0..10), Tangents=False)  # -> flatten(Curve)
crv_cp = CurveClosestPoint(Point=mcx_2.Points, Curve=graft(explode_2.Segments))  # -> Point, Parameter, Distance
equals = Equality(FirstNumber=crv_cp.Distance, SecondNumber=Slider(0, range=0..100))  # -> Equality, Inequality
panel_4 = Panel(crv_cp.Distance)
cull = CullPattern(List=crv_cp.Parameter, CullPattern=equals.Equality)
shatter_2 = Shatter(Curve=graft(explode_2.Segments), Parameters=cull)
crv_22 = Curve(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)
mesh_6 = Mesh(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)
crv_23 = Curve(parkbubbles.RouteCorridorEdges)
number_slider_23 = Slider(0.6, range=0..1)
c_script_7 = CSharpScript(
    Centroids=area_8.Centroid,
    Areas=area_8.Area,
    Boundary=parkbubbles.ResolvedBoundary,
    MinAspect=number_slider_19,
    Seed=Slider(9, range=0..10))  # -> out, Cells, CellCenters, ActualAreas, TargetAreas, AreaError, Displacement, LocalPlane; inputs Centroids: list of Point3d, Areas: list of Double, Boundary: Curve, MinAspect: Double, Seed: Int32; same code as c_script_2
treemappaths_2 = TreemapPathNetwork(
    Boundary=parkbubbles.ResolvedBoundary,
    Cells=c_script_7.Cells,
    ProgramIDs=parkbubbles.AreaProgramIDs,
    ProgramNames=parkbubbles.Names,
    MainEntrance=pt_9,
    SecondaryEntrance=pt_8,
    PrimaryWidth=3,
    SecondaryWidth=2,
    ServiceWidth=4,
    Run=toggle_2)  # -> PrimaryPath, SecondaryPaths, ServicePath, Portals, PortalData, CorridorEdges, PathData, Warnings, Summary
crv_24 = Curve(treemappaths_2.CorridorEdges)
toggle_3 = BooleanToggle(True)
wbloop = WeaverbirdsLoopSubdivision(MeshCurves=move_6.Geometry, Level=Slider(2, range=0..10), SmoothNakedEdges=1)
design_package_6 = Data(design_package_2)
meshedges_2 = MeshEdges(Mesh=wbloop)  # -> AllE, NakedE
pt_11 = Point(<point referenced from the Rhino model>)
parkcirculation_2 = GenerateCirculation(
    Boundary=parkbubbles.ResolvedBoundary,
    ProgramPolygons=c_script_7.Cells,
    ProgramIDs=parkbubbles.AreaProgramIDs,
    MainEntrance=pt_11,
    DesignPackage=design_package_6,
    CellSize=2,
    RouteReuse=0.35,
    Run=toggle_3,
    Smoothness=0.65,
    PolygonMode="AUTO",
    MaximumTerritoryFill=0.75)  # -> PrimaryPaths, SecondaryPaths, TertiaryPaths, ServicePaths, AccessCandidates, SelectedAccess, GraphNodes, BlockedGridCells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
pt_12 = Point()
pt_13 = Point(<point referenced from the Rhino model>)
crv_25 = Curve(parkbubbles.Routes)
selectbaraha = SelectBarahaCandidates(
    Boundary=parkbubbles.ResolvedBoundary,
    CandidateFootprints=parkbubbles.BarahaCandidateFootprints,
    CandidateData=parkbubbles.BarahaCandidateData,
    MaximumCount=Slider(4, range=0..10),
    Clearance=2,
    Run=toggle_3)  # -> SelectedFootprints, SelectedCenters, SelectedData, RejectedFootprints, Decisions, Summary
treeedgepaths = TreeEdgePathNetwork(
    Boundary=parkbubbles.ResolvedBoundary,
    Cells=c_script_7.Cells,
    ProgramIDs=parkbubbles.AreaProgramIDs,
    ProgramNames=parkbubbles.Names,
    Run=toggle_2)  # -> TreeEdgePaths, SharedEdgePortals, SnappedMainEntrance, PortalData, PathData, Warnings, Summary, ClippedCells
tag_3 = TextTag(Location=parkbubbles.Centers, Text=parkbubbles.Names)
number_slider_24 = Slider(0.9, range=0..10)
crv_26 = Curve(treeedgepaths.TreeEdgePaths)
tag_4 = TextTag(Location=c_script_7.CellCenters, Text=parkbubbles.Names)

# ---- group: Color code flow paths by catchment
preview_3 = CustomPreview(Geometry=flow_paths, Shader=colours)

# ---- group: Color code catchment boundaries
preview_4 = CustomPreview(Geometry=catchments_2, Shader=colours)

# ----
neg = Negative(Value=number_slider_24)
tag_5 = TextTag()
crv_27 = Curve(parkbubbles.Bubbles)
demesh = DeconstructMesh(Mesh=wbloop)  # -> Vertices, Faces, Colours, Normals
offcrv = OffsetCurve(Curve=crv_26, Plane=PlaneXY(0, 0, 0), Distance=number_slider_24, BothSides=neg, Kinks=0, CapType=1)
neg_2 = Negative()
duneterrain = GenerateDuneTerrain(
    ExistingTerrain=wbloop,
    Boundary=parkbubbles.ResolvedBoundary,
    DuneAxes=parkbubbles.DuneMorphologyAxes,
    DuneAxisNames=parkbubbles.DuneAxisNames,
    SelectedBarahas=selectbaraha.SelectedFootprints,
    LandscapeRidgeHeight=1.2,
    ArchitecturalRidgeHeight=Slider(8, range=0..10),
    RidgeOffset=Slider(20, range=0..100),
    RidgeHalfWidth=6,
    BarahaBermWidth=6,
    BalanceStrength=1,
    SmoothingPasses=3,
    Run=toggle_3)  # -> ProposedTerrain, RidgeCrestGuides, ValleyGuides, BarahaClearings, VertexDeltaZ, MaximumCut, MaximumFill, MeanActiveDelta, Summary
demesh_2 = DeconstructMesh(Mesh=duneterrain.ProposedTerrain)  # -> Vertices, Faces, Colours, Normals
dist = Distance(PointA=demesh.Vertices, PointB=demesh_2.Vertices)
mesh_7 = Mesh(duneterrain.ProposedTerrain)
crv_28 = Curve()
crv_29 = Curve(duneterrain.BarahaClearings)
crv_30 = Curve(duneterrain.ValleyGuides)
crv_31 = Curve(duneterrain.RidgeCrestGuides)
bnd = Bounds(Numbers=dist)
panel_5 = Panel(duneterrain.Summary)
dedomain = DeconstructDomain(Domain=bnd)  # -> Start, End
panel_6 = Panel(dist)
gradient_2 = Gradient(
    LowerLimit=dedomain.Start,
    UpperLimit=dedomain.End,
    Parameter=dist,
    stops=[0: RGB(48, 18, 59), 0.0294: RGB(56, 40, 112), 0.0588: RGB(63, 62, 156), 0.0882: RGB(68, 82, 193), 0.118: RGB(70, 102, 221), 0.147: RGB(71, 122, 241)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])
cutfill = EstimateParkCutFill(ExistingTerrain=wbloop, ProposedTerrain=duneterrain.ProposedTerrain, GridSpacing=2, Run=toggle_3)  # -> SamplePoints, DeltaZ, CutVolume, FillVolume, NetVolume, TotalEarthwork, DisturbedArea, MaximumCutDepth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
routeterrain = EvaluateTerrainRoutes(
    TerrainMesh=duneterrain.ProposedTerrain,
    Routes=parkbubbles.Routes,
    Mode="Walking",
    SampleSpacing=2,
    EnforceMaxSlope=invert(False),
    MaxSlopePercent=Slider(5, range=0..10),
    Run=toggle_3)  # -> TerrainRoutes, HorizontalLength, TerrainLength, ElevationGain, ElevationLoss, MaximumSlope, AverageSlope, SlopeViolationLength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
preview_5 = CustomPreview(Geometry=demesh_2.Vertices, Material=gradient_2)
panel_7 = Panel(routeterrain.Summary)
crv_32 = Curve(routeterrain.TerrainRoutes)
panel_8 = Panel(cutfill.Summary)

# ==== cluster Cluster
N = ClusterInput()
C = ClusterInput()
bbox = BoundingBox(Content=C, Plane=PlaneXY(0, 0, 0))  # -> Box, Box_2
debrep = DeconstructBrep(Brep=bbox.Box)  # -> Faces, Edges, Vertices
item = ListItem(List=debrep.Faces, Index=Slider(5, range=0..10), Wrap=True)
pop2d = Populate2D(Region=item, Count=N, Seed=1)
volume = Volume(Geometry=bbox.Box)  # -> Volume, Centroid
area = Area(Geometry=item)  # -> Area, Centroid
vector_2pt = Vector2Pt(PointA=area.Centroid, PointB=volume.Centroid, Unitize=False)  # -> Vector, Length
deconstruct_vector = DeconstructVector(Vector=vector_2pt.Vector)  # -> XComponent, YComponent, ZComponent
unit_z = UnitZ(Factor=deconstruct_vector.ZComponent)
project = ProjectPoint(Point=pop2d, Direction=unit_z, Geometry=C)  # -> Point, Index
P = ClusterOutput(project.Point)

# ==== cluster Cluster_2
crv = ClusterInput()
crv_2 = Curve(crv)
end = EndPoints(Curve=crv_2)  # -> Start, End
crv_3 = ClusterOutput(crv_2)
ln = Line(StartPoint=end.Start, EndPoint=end.End)
L = ClusterOutput(ln)
